# Grasshopper definition test.gh (Grasshopper 1.0.7)
# plug-ins: MyGrasshopperPlugin

colnumber = Slider(10, range=1..10)
rownumber = Slider(10, range=1..10)
test = TestPythonNET(TextToLower="HELLO", TextToUpper="from python.net")
startpy = StartPythonNET(
    StartPython=Toggle(True),
    UserMode=False,
    AnacondaDirectory="C:\Users\Jonas\Anaconda3",
    CondaEnvironmentName="base",
    Python3xxDllFile="python312.dll")
multiply = Multiply(A=rownumber, B=colnumber)
list = Panel(multiply)
panel = Panel(rownumber)
panel_2 = Panel(colnumber)
panel_3 = Panel(test)
executepython_net = APythonNETComponent(AListOfNumbers=list, RowNumber=panel, ColumnNumber=panel_2)
tree = Panel(executepython_net)

# ==== cluster Multiply
A = ClusterInput()
B = ClusterInput()
multiplication = Multiplication(A=A, B=B)
series = Series(Start=1, Step=1, Count=multiplication)
series_2 = ClusterOutput(series)
