# Grasshopper definition draw2D.gh (Grasshopper 1.0.8)
# plug-ins: CRFT Tools

number_slider = Slider(220, range=0..1000)
curve = Curve(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)
draw2d = Draw2D(Start=Toggle(True), InputCurves=curve, BedSizeX=number_slider, BedSizeY=number_slider)  # -> ServerURL, OutputCurves
panel = Panel(draw2d.OutputCurves)
panel_2 = Panel(draw2d.ServerURL)
path_to_g_code = PathToGCode(Curves=draw2d.OutputCurves, LiftHeight=1, ZDown=0, FeedRate=1000, TravelRate=3000)
panel_3 = Panel(path_to_g_code)
panel_4 = Panel("""G28
G21
G90
G1 Z1 F3000
G1 X155.425 Y183.482 F3000
G1 Z0 F3000
G1 X155.128 Y183.482 F1000
G1 X153.941 Y183.185 F1000
G1 X153.347 Y183.185 F1000
G1 X152.159 Y182.591 F1000
G1 X150.972 Y182.294 F1000
G1 X148.596 Y181.107 F1000
G1 X147.112 Y180.513 F1000
G1 X145.924 Y179.622 F1000
G1 X144.143 Y178.435 F1000
G1 X143.252 Y177.544 F1000
G1 X141.471 Y176.356 F1000
G1 X139.69 Y174.575 F1000
G1 X137.908 Y173.09 F1000
G1 X135.83 Y171.309 F1000
G1 X134.345 Y169.231 F1000
G1 X132.267 Y167.449 F1000
G1 X128.408 Y162.699 F1000
G1 X126.032 Y160.324 F1000
G1 X125.142 Y158.839 F1000
G1 X123.954 Y157.058 F1000
G1 X123.063 Y155.277 F1000
G1 X122.767 Y153.792 F1000
G1 X122.47 Y152.308 F1000
G1 X122.47 Y151.12 F1000
G1 X122.47 Y149.042 F1000
G1 X123.063 Y146.964 F1000
G1 X125.439 Y142.51 F1000
G1 X127.22 Y140.432 F1000
G1 X128.704 Y138.947 F1000
G1 X130.486 Y137.166 F1000
G1 X132.564 Y135.682 F1000
G1 X134.345 Y133.9 F1000
G1 X136.127 Y132.416 F1000
G1 X139.987 Y129.744 F1000
G1 X142.362 Y127.962 F1000
G1 X144.143 Y127.072 F1000
G1 X146.221 Y125.587 F1000
G1 X148.003 Y124.696 F1000
G1 X150.081 Y123.509 F1000
G1 X152.753 Y122.321 F1000
G1 X155.128 Y121.43 F1000
G1 X158.097 Y120.54 F1000
G1 X160.472 Y119.649 F1000
G1 X163.144 Y118.758 F1000
G1 X168.785 Y117.571 F1000
G1 X171.161 Y117.571 F1000
G1 X173.536 Y117.274 F1000
G1 X175.02 Y117.274 F1000
G1 X177.099 Y117.274 F1000
G1 X179.177 Y116.977 F1000
G1 X180.661 Y116.977 F1000
G1 X182.146 Y116.977 F1000
G1 X183.63 Y117.274 F1000
G1 X185.115 Y117.571 F1000
G1 X185.412 Y117.571 F1000
G1 X185.709 Y117.571 F1000
G1 X186.896 Y117.868 F1000
G1 X187.49 Y117.868 F1000
G1 X188.381 Y118.165 F1000
G1 X189.271 Y118.462 F1000
G1 X190.162 Y118.758 F1000
G1 X191.943 Y119.649 F1000
G1 X193.131 Y120.243 F1000
G1 X194.022 Y120.837 F1000
G1 X194.912 Y121.43 F1000
G1 X195.803 Y122.321 F1000
G1 X196.694 Y123.212 F1000
G1 X197.584 Y124.103 F1000
G1 X198.772 Y125.29 F1000
G1 X200.553 Y128.259 F1000
G1 X201.147 Y130.04 F1000
G1 X202.038 Y131.822 F1000
G1 X202.928 Y134.197 F1000
G1 X203.819 Y137.166 F1000
G1 X204.71 Y140.135 F1000
G1 X205.007 Y142.51 F1000
G1 X205.601 Y145.479 F1000
G1 X205.897 Y148.151 F1000
G1 X205.897 Y150.526 F1000
G1 X205.897 Y153.198 F1000
G1 X205.897 Y157.058 F1000
G1 X205.897 Y158.246 F1000
G1 X205.897 Y159.136 F1000
G1 X205.897 Y159.73 F1000
G1 X205.897 Y160.324 F1000
G1 X205.897 Y160.621 F1000
G1 X205.897 Y161.215 F1000
G1 X205.897 Y161.808 F1000
G1 X205.601 Y162.402 F1000
G1 X205.304 Y163.293 F1000
G1 X205.007 Y164.184 F1000
G1 X204.71 Y165.668 F1000
G1 X204.413 Y166.856 F1000
G1 X203.819 Y167.746 F1000
G1 X203.225 Y169.528 F1000
G1 X202.928 Y170.121 F1000
G1 X202.632 Y171.012 F1000
G1 X202.038 Y171.903 F1000
G1 X201.147 Y173.09 F1000
G1 X200.85 Y173.684 F1000
G1 X200.553 Y173.981 F1000
G1 X200.256 Y174.575 F1000
G1 X199.96 Y174.872 F1000
G1 X199.366 Y175.169 F1000
G1 X198.772 Y175.466 F1000
G1 X198.772 Y175.762 F1000
G1 X198.178 Y176.356 F1000
G1 X197.881 Y176.653 F1000
G1 X197.584 Y176.653 F1000
G1 X197.287 Y176.95 F1000
G1 X196.991 Y176.95 F1000
G1 X196.694 Y176.95 F1000
G1 X196.397 Y177.247 F1000
G1 X195.803 Y177.247 F1000
G1 X195.209 Y177.247 F1000
G1 X194.022 Y177.544 F1000
G1 X193.131 Y177.841 F1000
G1 X192.24 Y178.138 F1000
G1 X190.756 Y178.138 F1000
G1 X189.568 Y178.731 F1000
G1 X187.787 Y179.028 F1000
G1 X185.709 Y179.622 F1000
G1 X183.63 Y180.216 F1000
G1 X181.849 Y180.81 F1000
G1 X178.583 Y181.7 F1000
G1 X176.802 Y181.997 F1000
G1 X175.317 Y182.294 F1000
G1 X173.536 Y182.591 F1000
G1 X172.645 Y182.591 F1000
G1 X171.161 Y182.591 F1000
G1 X169.676 Y182.888 F1000
G1 X168.785 Y182.888 F1000
G1 X167.301 Y182.888 F1000
G1 X166.113 Y182.888 F1000
G1 X165.816 Y182.888 F1000
G1 X165.52 Y182.888 F1000
G1 X165.223 Y182.888 F1000
G1 X164.926 Y182.888 F1000
G1 X164.332 Y182.888 F1000
G1 X164.332 Y183.185 F1000
G1 X164.035 Y183.185 F1000
G1 X163.738 Y183.185 F1000
G1 X163.441 Y183.185 F1000
G1 X162.551 Y183.185 F1000
G1 X162.254 Y183.185 F1000
G1 X161.957 Y183.185 F1000
G1 X161.66 Y183.185 F1000
G1 X161.363 Y183.185 F1000
G1 X161.066 Y183.185 F1000
G1 X160.769 Y183.185 F1000
G1 X160.472 Y183.185 F1000
G1 X160.175 Y183.185 F1000
G1 X159.879 Y183.185 F1000
G1 X159.285 Y183.185 F1000
G1 X158.988 Y183.185 F1000
G1 X158.691 Y183.185 F1000
G1 X158.394 Y183.185 F1000
G1 X157.503 Y183.185 F1000
G1 X157.206 Y183.185 F1000
G1 X156.91 Y183.185 F1000
G1 X156.613 Y183.185 F1000
G1 X156.316 Y183.185 F1000
G1 X156.019 Y183.185 F1000
G1 X155.722 Y183.185 F1000
G1 X155.425 Y183.185 F1000
G1 X155.425 Y182.888 F1000
G1 X155.128 Y182.888 F1000
G1 X154.831 Y182.888 F1000
G1 X154.534 Y182.888 F1000
G1 X154.238 Y182.591 F1000
G1 Z1 F3000""")
boolean_toggle = BooleanToggle(True)
button = Button()
