# Grasshopper definition gcode.gh (Grasshopper 1.0.8)
# plug-ins: CRFT Tools

brep = Brep(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)
mesh = Mesh(brep)
mesh_to_voxels = MeshToVoxels(Geometry=mesh, VoxelSize=Slider(5, range=0..10))
voxel_convert = VoxelConvert(OutputFormat="raw")
blur_voxels = BlurVoxels(Voxels=mesh_to_voxels, Radius=1)
march_voxels = MarchVoxels(Voxels=blur_voxels, IsoValue=0.5)
voxel_viewer = VoxelViewer()
voxels_to_gcode = VoxelsToGCode(Voxels=march_voxels, FeedRate=1500)
