# Grasshopper definition infill.gh (Grasshopper 1.0.8)
# plug-ins: Pufferfish, CRFT Tools

brep = Brep(<brep referenced from the Rhino model>)

# ---- group: TypeC
brep_2 = Brep(<brep referenced from the Rhino model>)

# ---- group: TypeA
brep_3 = Brep(<brep referenced from the Rhino model>)

# ---- group: TypeB
brep_4 = Brep(<brep referenced from the Rhino model>)

# ----
debrep = DeconstructBrep(Brep=brep)  # -> Faces, Edges, Vertices
cluster = Cluster(srf=debrep.Faces, B=Slider(0.59, range=0..1))
join = BrepJoin(Breps=cluster)  # -> Breps, Closed

edges = BrepEdges(Brep=join.Breps)  # -> Naked, Interior, NonManifold
join_2 = JoinCurves(Curves=edges.Naked, Preserve=False)
explode = Explode(Curve=join_2, Recursive=True)  # -> Segments, Vertices
pdecon = Deconstruct(Point=explode.Vertices)  # -> XComponent, YComponent, ZComponent
sort = SortList(Keys=pdecon.ZComponent, ValuesA=explode.Vertices)  # -> reverse(Keys), ValuesA
item = ListItem(List=sort.Keys, Index=0, Wrap=True)
pt = ConstructPoint(XCoordinate=pdecon.XComponent, YCoordinate=pdecon.YComponent, ZCoordinate=item)
pline = PolyLine(Vertices=pt, Closed=False)

# ---- group: 底面を抽出する
cluster_2 = Cluster_2(srf=debrep.Faces)

# ----
neg = Negative(Value=Slider(0.3, range=0..1))
offset = OffsetCurve(Curve=pline, Distance=neg, Corners=1)
project = Project(Curve=offset, Brep=cluster_2, Direction=Vector(0, 0, 1))

edges_2 = BrepEdges(Brep=cluster_2)  # -> Naked, Interior, NonManifold
join_3 = JoinCurves(Curves=edges_2.Naked, Preserve=False)
offset_2 = OffsetCurve(Curve=join_3, Distance=1, Corners=1)

number_slider = Slider(1, range=0..1)
cluster_3 = Cluster_3(num=number_slider)  # -> x_center, y_center, centerpt, rectangle_2, print_area, print_start_height, print_height, layer_height, seamcutter
printer_params = PrinterParams(G=number_slider)  # -> ext_ratio_2, ext_height_2, ext_width_2, fillament
startcode = Startcode(num=Slider(210, range=0..240), num_3=Slider(60, range=50..100), G=Slider(1, range=0..10))
cluster_4 = Cluster_4(G=number_slider)
rec = Rectangle(cluster_3.print_area)

number_of_topsurface = Slider(2, range=0..2)

brep_5 = Brep(brep)
neg_2 = Negative(Value=Slider(0.3, range=0..1))
Z = UnitZ(Factor=neg_2)
arrlinear = LinearArray(Geometry=join.Breps, Direction=Z, Count=expr("x+1", number_of_topsurface))  # -> Geometry, Transform
lastdex = LastIndex(List=arrlinear.Geometry)
item_2 = ListItem(List=arrlinear.Geometry, Index=lastdex, Wrap=True)
split = SplitBrep(Brep=brep_5, Cutter=item_2)
item_3 = ListItem(List=split, Index=Slider(1, range=0..1), Wrap=True)
merge = Merge(Data1=item_2, Data2=item_3)  # -> flatten(Result)
join_4 = BrepJoin(Breps=merge)  # -> Breps, Closed

move_to_center = MoveToCenter(G=brep, X=cluster_3.x_center, Y=cluster_3.y_center, F=Slider(0.25, range=0..1))  # -> simplify(flatten(G_2)), X_2
number_slider_2 = Slider(1, range=0..10)

pt_2 = ConstructPoint(XCoordinate=0, YCoordinate=0, ZCoordinate=Slider(0.08, range=0..0.1))
Z_2 = UnitZ(Factor=1)
contour = Contour(Shape=join_4.Breps, Point=pt_2, Direction=Z_2, Distance="0.2")  # -> simplify(Contours)
series = Series(Start=0, Step=1, Count=Slider(2, range=0..10))
flatten = FlattenTree(Tree=contour, Path="{0}")
item_4 = ListItem(List=flatten, Index=series, Wrap=True)

number_slider_3 = Slider(3, range=0..10)
multiplication = Multiplication(A=printer_params.ext_ratio_2, B=Slider(1.9, range=0..10))
number_slider_4 = Slider(4800, range=0..10000)
number_slider_5 = Slider(1500, range=0..10000)
number_slider_6 = Slider(2, range=0..10)
number_slider_7 = Slider(1800, range=0..10000)

number_slider_8 = Slider(1, range=0..1)
cluster_5 = Cluster_3(num=number_slider_8)  # -> x_center, y_center, centerpt, rectangle_2, print_area, print_start_height, print_height, layer_height, seamcutter
printer_params_2 = PrinterParams(G=number_slider_8)  # -> ext_ratio_2, ext_height_2, ext_width_2, fillament
startcode_2 = Startcode(num=Slider(210, range=0..240), num_3=Slider(60, range=50..100), G=Slider(1, range=0..10))
cluster_6 = Cluster_4(G=number_slider_8)

cluster_7 = Cluster_7(endcode=cluster_4, safe_z_distance=Slider(10, range=0..10))
data = Data(cluster_7)

tstat = TreeStatistics(Tree=simplify(graft(item_4)))  # -> Paths, Length, Count
dpath = DeconstructPath(Branch=tstat.Paths)
mod = Modulus(A=dpath, B=2)  # -> simplify(Result)
cull = CullPattern(List=simplify(graft(item_4)), CullPattern=mod)
cull_2 = CullPattern(List=simplify(graft(item_4)), CullPattern=invert(mod))
seam = Seam(Curve=reparameterize(cull_2), Seam="0.25")
merge_2 = Merge(Data1=cull, Data2=seam)

lastptandendcode = LastPtAndEndCode()
skirt_layer = SkirtLayer(G=0, D=1, S=1)  # -> S_2, V
retractioncode = RetractionCode()
nonprintgcode = NonPrintGcode()

neg_3 = Negative(Value="0.5")

move_to_center_2 = MoveToCenter(X=0, Y=0, F=1)  # -> simplify(flatten(G_2)), X_2
cluster_8 = Cluster_5(L=Slider(1, range=0..1), S=Slider(200, range=0..1000))  # -> S_2, V

offset_3 = OffsetCurve(Curve=merge_2, Distance=neg_3, Corners=1)
lastdex_2 = LastIndex(List=offset_3)
item_5 = ListItem(List=offset_3, Index=lastdex_2, Wrap=True)
divide = DivideCurve(Curve=item_5, Count="4", Kinks=False)  # -> Points, Tangents, Parameters
lng = ListLength(List=divide.Points)
division = Division(A=lng, B="2")
item_6 = ListItem(List=divide.Points, Index=division, Wrap=True)
item_7 = ListItem(List=divide.Points, Index=0, Wrap=True)
ln = Line(StartPoint=item_6, EndPoint=item_7)
divlength = DivideLength(Curve=ln, Length=Slider(0.7, range=0..10))  # -> Points, Tangents, Parameters

extrusioncalculator = ExtrusionCalculator()
printinggcode = PrintingGcode()

list = SerialPorts({"cu.debug-console", "cu.JBLRACETWS", "cu.Bluetooth-Incoming-Port"}, selected="cu.debug-console")

pl = PlaneNormal(Origin=divlength.Points, ZAxis=divlength.Tangents)
deplane = DeconstructPlane(Plane=pl)  # -> Origin, XAxis, YAxis, ZAxis
line = LineSDL(Start=deplane.Origin, Direction=deplane.XAxis, Length=1)
cull_i = CullIndex(List=line, Indices=0, Wrap=True)
end = EndPoints(Curve=simplify(cull_i))  # -> graft(Start), graft(End)
vec2pt = Vector2Pt(PointA=end.Start, PointB=end.End, Unitize=False)  # -> Vector, Length
neg_4 = Negative(Value=vec2pt.Vector)
project_2 = ProjectPoint(Point=end.Start, Direction=[vec2pt.Vector, neg_4], Geometry=simplify(flatten(item_5)))  # -> Point, Index
item_8 = ListItem(List=project_2.Point, Index=0, Wrap=True)  # -> Item, Item1
ln_2 = Line(StartPoint=item_8.Item, EndPoint=item_8.Item1)

end_2 = EndPoints(Curve=simplify(ln))  # -> Start, End
pshift = ShiftPaths(Data=project_2.Point, Offset=-1)
merge_3 = Merge(Data1=pshift, Data2=end_2.Start, Data3=end_2.End)
crv_cp = CurveClosestPoint(Point=merge_3, Curve=simplify(item_5))  # -> Point, Parameter, Distance
shatter = Shatter(Curve=item_5, Parameters=crv_cp.Parameter)  # -> simplify(Segments)

pshift_2 = ShiftPaths(Data=ln_2, Offset=-1)
cull_3 = CullPattern(List=shatter, CullPattern=[False, True])
merge_4 = Merge(Data1=cull_3, Data2=pshift_2)
join_5 = JoinCurves(Curves=merge_4, Preserve=False)
merge_5 = Merge(Data1=merge_2, Data2=simplify(offset_3), Data3=simplify(join_5))

# ---- group: Bottom
crv = Curve(merge_5)

# ----
transform = Transform(Geometry=crv, Transform=move_to_center.X_2)
item_9 = ListItem(List=flatten(transform), Index=0, Wrap=True)
cluster_9 = Cluster_6(
    flip=Slider(0, range=0..1),
    firstlayer=item_9,
    offset=Slider(6, range=0..10),
    pitch=number_slider_2,
    startposition=Slider(0, range=0..74))  # -> S, V
cluster_10 = Cluster_5(crv=transform, L=number_slider_2, S=1)  # -> simplify(S_2), V
len = Length(Curve=cluster_10.S_2)
len_2 = Length(Curve=cluster_9.S)
extrusioncalculator_2 = ExtrusionCalculator(
    A_2=multiplication,
    B=len,
    C=printer_params.ext_height_2,
    D=printer_params.ext_width_2,
    y=number_slider_3,
    A=printer_params.fillament)
extrusioncalculator_3 = ExtrusionCalculator(
    A_2=multiplication,
    B=len_2,
    C=printer_params.ext_height_2,
    D=printer_params.ext_width_2,
    y=number_slider_3,
    A=printer_params.fillament)
printinggcode_2 = PrintingGcode(移動スピード=number_slider_4, L=cluster_9.V, I=extrusioncalculator_3, K=number_slider_5)
printinggcode_3 = PrintingGcode(移動スピード=number_slider_4, L=simplify(cluster_10.V), I=extrusioncalculator_2, K=number_slider_5)
retraction_code = RetractionCode_2(retract=number_slider_6, F=number_slider_7, gcode=printinggcode_3)

merge_6 = Merge(Data1=offset_2, Data2=project)  # -> flatten(Result)
merge_7 = Merge(Data1=offset, Data2=project)
merge_8 = Merge(Data1=pline, Data2=offset)
merge_9 = Merge(Data1=pline, Data2=offset_2)

# ---- group: 内側の面
loft = Loft(Curves=flatten(merge_7), Options={Adjust=True, Closed=False, LoftEnds=0, LoftSimp=0, LoftType=0, Rebuild=10, Refit=0.01})

# ---- group: 上面の縁
loft_2 = Loft(Curves=flatten(merge_8), Options={Adjust=True, Closed=False, LoftEnds=0, LoftSimp=0, LoftType=0, Rebuild=10, Refit=0.01})

# ---- group: 外側の面
loft_3 = Loft(Curves=merge_9, Options={Adjust=True, Closed=False, LoftEnds=0, LoftSimp=0, LoftType=0, Rebuild=10, Refit=0.01})

boundary = BoundarySurfaces(Edges=merge_6)

# ----
merge_10 = Merge(Data1=loft_3, Data2=loft_2, Data3=boundary, Data4=loft)  # -> flatten(Result)

# ---- group: ClosedBrepになっている必要あり
join_6 = BrepJoin(Breps=merge_10)  # -> Breps, Closed

# ---- group: Top縁用
sint = SolidIntersection(BrepsA=brep, BrepsB=join_6.Breps)

# ---- group: Top面用
sdiff = SolidDifference(BrepsA=brep, BrepsB=join_6.Breps)

# ----
brep_6 = Brep(sint)
debrep_2 = DeconstructBrep(Brep=brep_6)  # -> Faces, Edges, Vertices
cluster_11 = Cluster(srf=debrep_2.Faces, B=Slider(0.59, range=0..1))
join_7 = BrepJoin(Breps=cluster_11)  # -> Breps, Closed

preview = CustomPreview(Geometry=crv, Material=ColourSwatch(SwatchColor=RGB(0, 125, 247)))

brep_7 = Brep(sdiff)
debrep_3 = DeconstructBrep(Brep=brep_7)  # -> Faces, Edges, Vertices
cluster_12 = Cluster(srf=debrep_3.Faces, B=Slider(0.59, range=0..1))

join_8 = BrepJoin(Breps=cluster_12)  # -> Breps, Closed

arrlinear_2 = LinearArray(Geometry=join_8.Breps, Direction=Z, Count=number_of_topsurface)  # -> Geometry, Transform

tstat_2 = TreeStatistics(Tree=contour)  # -> Paths, Length, Count
cull_i_2 = CullIndex(List=tstat_2.Paths, Indices=series, Wrap=True)
split_2 = SplitTree(Data=contour, Masks=flatten(cull_i_2))  # -> Positive, Negative
crv_2 = Curve(split_2.Positive)

boundary_2 = BoundarySurfaces(Edges=graft(crv_2))
area = Area(Geometry=boundary_2)  # -> Area, Centroid
cir = Circle(Plane=area.Centroid, Radius=1)
flip = FlipCurve(Curve=graft(crv_2), Guide=cir)  # -> Curve, flatten(Flag)

curvepoint = PointOnCurve(crv_2, parameter=1)
curvepoint_2 = PointOnCurve(flip.Curve, parameter=0)

xy = XYPlane(Origin=Point(0, 0, 0))
offset_4 = OffsetCurve(Curve=simplify(flip.Curve), Distance=neg_3, Plane=xy, Corners=Slider(1, range=0..10))  # -> simplify(Curve)
unflatten = UnflattenTree(Tree=flip.Curve, Guide=crv_2)
unflatten_2 = UnflattenTree(Tree=offset_4, Guide=crv_2)
merge_11 = Merge(Data1=unflatten, Data2=unflatten_2)

crv_3 = Curve(merge_11)

# ---- group: Outline
crv_4 = Curve(crv_3)

# ----
preview_2 = CustomPreview(Geometry=crv_4, Material=ColourSwatch(SwatchColor=RGB(247, 247, 0)))

transform_2 = Transform(Geometry=crv_4, Transform=move_to_center.X_2)
cluster_13 = Cluster_5(crv=transform_2, L=number_slider_2, S=1)  # -> simplify(S_2), V
len_3 = Length(Curve=cluster_13.S_2)
extrusioncalculator_4 = ExtrusionCalculator(
    A_2=printer_params.ext_ratio_2,
    B=len_3,
    C=printer_params.ext_height_2,
    D=printer_params.ext_width_2,
    y=number_slider_3,
    A=printer_params.fillament)
printinggcode_4 = PrintingGcode(移動スピード=number_slider_4, L=simplify(cluster_13.V), I=extrusioncalculator_4, K=number_slider_5)
retraction_code_2 = RetractionCode_2(retract=number_slider_6, F=number_slider_7, gcode=printinggcode_4)
entwine = Entwine(
    Branch00=startcode,
    Branch01=printinggcode_2,
    Branch02=retraction_code,
    Branch03=retraction_code_2,
    Branch04=data,
    FlattenInputs=True)
flatten_2 = FlattenTree(Tree=entwine, Path="{0}")
panel = Panel(flatten_2)
serial_control = SerialControl(
    Port=list,
    BaudRate=115200,
    Connect=False,
    Command=panel,
    Reset=False,
    BoundingBox=Vector(220, 220, 250),
    ShowBBox=False,
    Samples=0)  # -> Response, PortEvent, Path, GCode

# ==== cluster Cluster
srf = ClusterInput()
srf_2 = Surface(srf)
area = Area(Geometry=srf_2)  # -> Area, Centroid
srf_cp = SurfaceClosestPoint(Point=area.Centroid, Surface=srf_2)  # -> Point, UVPoint, Distance
evalsrf = EvaluateSurface(Surface=srf_2, Point=srf_cp.UVPoint)  # -> Point, Normal, UDirection, VDirection, Frame
B = ClusterInput()
devec = DeconstructVector(Vector=evalsrf.Normal)  # -> XComponent, YComponent, ZComponent
vdis = VectorDisplay(Anchor=evalsrf.Point, Vector=evalsrf.Normal)
larger = LargerThan(FirstNumber=devec.ZComponent, SecondNumber=B)  # -> LargerThan, OrEqualTo
cull = CullPattern(List=srf_2, CullPattern=larger.OrEqualTo)
L = ClusterOutput(cull)

# ==== cluster Cluster_2
srf = ClusterInput()
srf_2 = Surface(srf)
area = Area(Geometry=srf_2)  # -> Area, Centroid
srf_cp = SurfaceClosestPoint(Point=area.Centroid, Surface=srf_2)  # -> Point, UVPoint, Distance
evalsrf = EvaluateSurface(Surface=srf_2, Point=srf_cp.UVPoint)  # -> Point, Normal, UDirection, VDirection, Frame
devec = DeconstructVector(Vector=evalsrf.Normal)  # -> XComponent, YComponent, ZComponent
vdis = VectorDisplay(Anchor=evalsrf.Point, Vector=evalsrf.Normal)
equals = Equality(FirstNumber=devec.ZComponent, SecondNumber="-1")  # -> Equality, Inequality
cull = CullPattern(List=srf_2, CullPattern=equals.Equality)
L = ClusterOutput(cull)

# ==== cluster Startcode
num = ClusterInput()
num_2 = Number(num)
concat = Concatenate(FragmentA="M109 S", FragmentB=num_2)
concat_2 = Concatenate(FragmentA="M104 S", FragmentB=num_2)
ender5 = Panel("""G21 ; Set units to milimeters
T0
G28 ; Go home
G90 ; Set to Absolute Positioning
G92 E0 ; Set to home current position
M82 ; Use absolute distances for extrusion

G1 E6 F200
M106
G1 X0 Y0 Z1.5 E0 F4500 ; go""")
atom = Panel("""G21 ; Set units to milimeters
T0
G28 ; Go home
G90 ; Set to Absolute Positioning
G92 E0 ; Set to home current position
M82 ; Use absolute distances for extrusion

G1 E6 F200
M106
G1 X0 Y0 Z1.5 E0 F4500 ; go""")
num_3 = ClusterInput()
num_4 = Number(num_3)
concat_3 = Concatenate(FragmentA="M190 S", FragmentB=num_4)
concat_4 = Concatenate(FragmentA="M140 S", FragmentB=num_4)
merge = Merge(Data1=concat_4, Data2=concat_3, Data3=concat_2, Data4=concat)
merge_2 = Merge(Data1=concat_4, Data2=concat_3, Data3=concat_2, Data4=concat)
ins = InsertItems(List=atom, Item=merge, Indices=3, Wrap=True)  # -> flatten(List)
ins_2 = InsertItems(List=ender5, Item=merge_2, Indices=3, Wrap=True)  # -> flatten(List)
G = ClusterInput()
filter = StreamFilter(Gate=G, Stream0=ins, Stream1=ins_2)
startcode = Data(filter)
startcode_2 = ClusterOutput(startcode)

# ==== cluster Cluster_3
num = ClusterInput()
num_2 = Number(num)

# ----
# Ender5
プリント開始高さ = Slider(0.2, range=0..10)
レイヤーピッチ = Slider(0.9, range=0..10)
x_domain = Panel("220")
y_domain = Panel("220")
z_domain = Panel("300")
rectangle = Rectangle(Plane=PlaneXY(0, 0, 0), XSize=x_domain, YSize=y_domain, Radius=0)  # -> Rectangle, Length

number_slider = Slider(0.25, range=0..1)
filter = StreamFilter(Gate=num_2, Stream1=プリント開始高さ)
filter_2 = StreamFilter(Gate=num_2, Stream1=z_domain)
filter_3 = StreamFilter(Gate=num_2, Stream1=レイヤーピッチ)
filter_4 = StreamFilter(Gate=num_2, Stream1=rectangle.Rectangle)
rec = Rectangle(filter_4)
Z = UnitZ(Factor=number_slider)
move = Move(Geometry=rec, Motion=Z)  # -> Geometry, Transform
drec = DeconstuctRectangle(Rectangle=filter_4)  # -> BasePlane, XInterval, YInterval
dedomain = DeconstructDomain(Domain=drec.XInterval)  # -> Start, End
dedomain_2 = DeconstructDomain(Domain=drec.YInterval)  # -> Start, End
division = Division(A=dedomain.End, B=2)
division_2 = Division(A=dedomain_2.End, B=2)
pt = ConstructPoint(XCoordinate=division, YCoordinate=division_2, ZCoordinate=number_slider)
pt_2 = ConstructPoint(XCoordinate=0, YCoordinate=0, ZCoordinate=0)
line = LineSDL(Start=pt_2, Direction=Vector(0, 0, 1), Length=filter_2)
line_2 = LineSDL(Start=pt, Direction=Vector(0, 0, 1), Length=filter_2)
loft = Loft(Curves=[line_2, line], Options={Adjust=False, Closed=False, LoftEnds=0, LoftSimp=0, LoftType=0, Rebuild=10, Refit=0.01})
print_start_height = ClusterOutput(filter)
layer_height = ClusterOutput(filter_3)
print_height = ClusterOutput(filter_2)
rectangle_2 = ClusterOutput(move.Geometry)
print_area = ClusterOutput(filter_4)
y_center = ClusterOutput(division_2)
x_center = ClusterOutput(division)
centerpt = ClusterOutput(pt)
seamcutter = ClusterOutput(loft)

# ==== cluster PrinterParams

# ----
# Ender5
ext_width = Slider(0.24, range=0..10)
filament = Slider(1.75, range=0..250)
ext_height = Slider(0.2, range=0..10)
ext_ratio = Slider(1.2, range=0..3)

G = ClusterInput()

filter = StreamFilter(Gate=G, Stream1=ext_ratio)
filter_2 = StreamFilter(Gate=G, Stream1=ext_height)
filter_3 = StreamFilter(Gate=G, Stream1=ext_width)
filter_4 = StreamFilter(Gate=G, Stream1=filament)

ext_ratio_2 = ClusterOutput(filter)
ext_height_2 = ClusterOutput(filter_2)
ext_width_2 = ClusterOutput(filter_3)
fillament = ClusterOutput(filter_4)

# ==== cluster Cluster_4
ender5_end = Panel("""M104 S0 ; turn off extruder
M140 S0 ; turn off bed
G1 Y0
M84 ; disable motors""")
G = ClusterInput()
filter = StreamFilter(Gate=G, Stream1=ender5_end)
s_1 = ClusterOutput(filter)

# ==== cluster MoveToCenter
G = ClusterInput()
F = ClusterInput()
X = ClusterInput()
Y = ClusterInput()
Z = UnitZ(Factor=F)
area = Area(Geometry=G)  # -> Area, Centroid
pdecon = Deconstruct(Point=area.Centroid)  # -> XComponent, YComponent, ZComponent
neg = Negative(Value=Z)
pt = ConstructPoint(XCoordinate=pdecon.XComponent, YCoordinate=pdecon.YComponent, ZCoordinate=0)
pt_2 = ConstructPoint(XCoordinate=X, YCoordinate=Y, ZCoordinate=neg)
vec2pt = Vector2Pt(PointA=pt, PointB=pt_2, Unitize=False)  # -> Vector, Length
move = Move(Geometry=G, Motion=vec2pt.Vector)  # -> Geometry, Transform
G_2 = ClusterOutput(move.Geometry)
X_2 = ClusterOutput(move.Transform)

# ==== cluster Cluster_5
crv = ClusterInput()
crv_2 = Curve(crv)
L = ClusterInput()
divlength = DivideLength(Curve=crv_2, Length=L)  # -> Points, Tangents, Parameters
S = ClusterInput()
shift = ShiftList(List=divlength.Points, Shift=S, Wrap=True)
pline = PolyLine(Vertices=shift, Closed=False)
explode = Explode(Curve=pline, Recursive=True)  # -> Segments, Vertices
S_2 = ClusterOutput(explode.Segments)
V = ClusterOutput(explode.Vertices)

# ==== cluster ExtrusionCalculator
A = ClusterInput()
A_2 = ClusterInput()
B = ClusterInput()
C = ClusterInput()
D = ClusterInput()
pi = Pi(Factor=1)
division = Division(A=A, B=2)
multiplication = Multiplication(A=pi, B=division, C=division)
multiplication_2 = Multiplication(A=A_2, B=B, C=C, D=D)
division_2 = Division(A=multiplication_2, B=multiplication)
ma = MassAddition(Input=division_2)  # -> Result, PartialResults
y = ClusterInput()
expression = Expression(x=ma.PartialResults, y=y, Expression="Round(x,y)")
R = ClusterOutput(expression)

# ==== cluster PrintingGcode
移動スピード = ClusterInput()
L = ClusterInput()
item = ListItem(List=L, Index="0", Wrap=True)
cull_i = CullIndex(List=L, Indices="0", Wrap=True)
pdecon = Deconstruct(Point=item)  # -> XComponent, YComponent, ZComponent
pdecon_2 = Deconstruct(Point=cull_i)  # -> XComponent, YComponent, ZComponent
I = ClusterInput()
K = ClusterInput()
concat = Concatenate(
    FragmentA="G1",
    FragmentB=" X",
    FragmentC=pdecon.XComponent,
    FragmentD=" Y",
    FragmentE=pdecon.YComponent,
    FragmentF=" Z",
    FragmentG=pdecon.ZComponent,
    FragmentJ=" F",
    FragmentK=移動スピード)  # -> simplify(Result)
concat_2 = Concatenate(
    FragmentA="G1",
    FragmentB=" X",
    FragmentC=pdecon_2.XComponent,
    FragmentD=" Y",
    FragmentE=pdecon_2.YComponent,
    FragmentF=" Z",
    FragmentG=pdecon_2.ZComponent,
    FragmentH=" E",
    FragmentI=I,
    FragmentJ=" F",
    FragmentK=K)  # -> simplify(Result)
merge = Merge(Data1=concat, Data2=concat_2)
R = ClusterOutput(merge)

# ==== cluster LastPtAndEndCode
P = ClusterInput()
pdecon = Deconstruct(Point=P)  # -> XComponent, YComponent, ZComponent
flatten = FlattenTree(Tree=pdecon.ZComponent, Path="{0}")
lastdex = LastIndex(List=flatten)
B = ClusterInput()
item = ListItem(List=flatten, Index=lastdex, Wrap=True)
addition = Addition(A=item, B=B)
panel = Panel(addition)
concat = Concatenate(FragmentA="G1 Z", FragmentB=panel, FragmentC=" F1000")
L = ClusterInput()
ins = InsertItems(List=L, Item=concat, Indices=0, Wrap=True)
L_2 = ClusterOutput(ins)

# ==== cluster NonPrintGcode
P = ClusterInput()
pdecon = Deconstruct(Point=P)  # -> XComponent, YComponent, ZComponent
I = ClusterInput()
concat = Concatenate(
    FragmentA="G1",
    FragmentB=" X",
    FragmentC=pdecon.XComponent,
    FragmentD=" Y",
    FragmentE=pdecon.YComponent,
    FragmentF=" Z",
    FragmentG=pdecon.ZComponent,
    FragmentH=" F",
    FragmentI=I)
R = ClusterOutput(concat)

# ==== cluster RetractionCode
retract = ClusterInput()
F = ClusterInput()
retract_2 = Number(retract)
F_2 = Number(F)
gcode = ClusterInput()
concat = Concatenate(FragmentA="G1 E-", FragmentB=retract_2, FragmentC=" F", FragmentD=F_2)
gcode_2 = Data(gcode)
weave = Weave(Pattern=[0, 1, 2], Stream0="G92 E0", Stream1=concat, Stream2=gcode_2, NullGaps=False)
concat_2 = Concatenate(FragmentA="G1 E", FragmentB="0", FragmentC=" F", FragmentD=F_2)
ins = InsertItems(List=weave, Item=concat_2, Indices="3", Wrap=True)  # -> simplify(List)
L = ClusterOutput(ins)
panel = Panel(ins)

# ==== cluster SkirtLayer
C = ClusterInput()
D = ClusterInput()
offset = OffsetCurve(Curve=C, Distance=D, Corners=1)
G = ClusterInput()
flip = FlipCurve(Curve=offset)  # -> Curve, Flag
filter = StreamFilter(Gate=G, Stream0=offset, Stream1=flip.Curve)
L = ClusterInput()
divlength = DivideLength(Curve=filter, Length=L)  # -> Points, Tangents, Parameters
S = ClusterInput()
shift = ShiftList(List=divlength.Points, Shift=S, Wrap=True)
pline = PolyLine(Vertices=shift, Closed=False)
explode = Explode(Curve=pline, Recursive=True)  # -> Segments, Vertices
S_2 = ClusterOutput(explode.Segments)
V = ClusterOutput(explode.Vertices)

# ==== cluster Cluster_6
firstlayer = ClusterInput()
flip = ClusterInput()
offset = ClusterInput()
firstlayer_2 = Curve(firstlayer)
flip_2 = Number(flip)
offset_2 = Number(offset)
offset_3 = OffsetCurve(Curve=firstlayer_2, Distance=offset_2, Corners=1)
flip_3 = FlipCurve(Curve=offset_3)  # -> Curve, Flag
pitch = ClusterInput()
startposition = ClusterInput()
filter = StreamFilter(Gate=flip_2, Stream0=offset_3, Stream1=flip_3.Curve)
pitch_2 = Number(pitch)
startposition_2 = Number(startposition)
divlength = DivideLength(Curve=filter, Length=pitch_2)  # -> Points, Tangents, Parameters
shift = ShiftList(List=divlength.Points, Shift=startposition_2, Wrap=True)
pline = PolyLine(Vertices=shift, Closed=False)
explode = Explode(Curve=pline, Recursive=True)  # -> Segments, Vertices
S = ClusterOutput(explode.Segments)
V = ClusterOutput(explode.Vertices)

# ==== cluster RetractionCode_2
F = ClusterInput()
retract = ClusterInput()
F_2 = Number(F)
retract_2 = Number(retract)
gcode = ClusterInput()
concat = Concatenate(FragmentA="G1 E-", FragmentB=retract_2, FragmentC=" F", FragmentD=F_2)
gcode_2 = Data(gcode)
concat_2 = Concatenate(FragmentA="G1 E", FragmentB="0", FragmentC=" F", FragmentD=F_2)
weave = Weave(Pattern=[0, 1, 2], Stream0="G92 E0", Stream1=concat, Stream2=gcode_2, NullGaps=False)
ins = InsertItems(List=weave, Item=concat_2, Indices="3", Wrap=True)
L = ClusterOutput(ins)

# ==== cluster Cluster_7
lastpoint = ClusterInput()
lastpoint_2 = Point(lastpoint)
pdecon = Deconstruct(Point=lastpoint_2)  # -> XComponent, YComponent, ZComponent
flatten = FlattenTree(Tree=pdecon.ZComponent, Path="{0}")
lng = ListLength(List=flatten)
safe_z_distance = ClusterInput()
item = ListItem(List=flatten, Index=lng, Wrap=True)
addition = Addition(A=item, Safe_Z_distance=safe_z_distance)
endcode = ClusterInput()
endcode_2 = Data(endcode)
concat = Concatenate(FragmentA="G1 Z", FragmentB=addition, FragmentC=" F1000")
ins = InsertItems(List=endcode_2, Item=concat, Indices="0", Wrap=True)
L = ClusterOutput(ins)
