# Grasshopper definition path.ghx (Grasshopper 1.0.8)
# plug-ins: Pufferfish, CRFT Tools

brep = Brep(<brep referenced from the Rhino model>)

debrep = DeconstructBrep(Brep=brep)  # -> Faces, Edges, Vertices
cluster = Cluster(srf=debrep.Faces, B=Slider(0.59, range=0..1))
join = BrepJoin(Breps=cluster)  # -> Breps, Closed

brep_2 = Brep(brep)
number_of_topsurface = Slider(1, range=0..2)
neg = Negative(Value=Slider(0.3, range=0..1))
Z = UnitZ(Factor=neg)
arrlinear = LinearArray(Geometry=join.Breps, Direction=Z, Count=expr("x+1", number_of_topsurface))  # -> Geometry, Transform
lastdex = LastIndex(List=arrlinear.Geometry)
item = ListItem(List=arrlinear.Geometry, Index=lastdex, Wrap=True)
split = SplitBrep(Brep=brep_2, Cutter=item)
item_2 = ListItem(List=split, Index=Slider(1, range=0..1), Wrap=True)
merge = Merge(Data1=item, Data2=item_2)  # -> flatten(Result)
join_2 = BrepJoin(Breps=merge)  # -> Breps, Closed
Z_2 = UnitZ(Factor=1)
pt = ConstructPoint(XCoordinate=0, YCoordinate=0, ZCoordinate=Slider(0.08, range=0..0.1))
contour = Contour(Shape=join_2.Breps, Point=pt, Direction=Z_2, Distance="0.8")  # -> simplify(Contours)
tstat = TreeStatistics(Tree=contour)  # -> Paths, Length, Count
series = Series(Start=0, Step=1, Count=Slider(2, range=0..10))
cull_i = CullIndex(List=tstat.Paths, Indices=series, Wrap=True)
split_2 = SplitTree(Data=contour, Masks=flatten(cull_i))  # -> Positive, Negative
crv = Curve(split_2.Positive)

number_slider = Slider(1, range=0..1)
cluster_2 = Cluster_3(num=number_slider)  # -> x_center, y_center, centerpt, rectangle_2, print_area, print_start_height, print_height, layer_height, seamcutter
printer_params = PrinterParams(G=number_slider)  # -> ext_ratio_2, ext_height_2, ext_width_2, fillament
startcode = Startcode(num=Slider(210, range=0..240), num_3=Slider(60, range=50..100), G=Slider(1, range=0..10))
cluster_3 = Cluster_4(G=number_slider)
rec = Rectangle(cluster_2.print_area)

number_slider_2 = Slider(1, range=0..10)
move_to_center = MoveToCenter(G=brep, X=cluster_2.x_center, Y=cluster_2.y_center, F=Slider(0.25, range=0..1))  # -> simplify(flatten(G_2)), X_2
move_speed = Slider(4800, range=0..10000)
print_speed = Slider(1500, range=0..10000)
cluster_4 = Cluster_5(L=number_slider_2, S=1)  # -> simplify(S_2), V
number_slider_3 = Slider(3, range=0..10)
len = Length(Curve=cluster_4.S_2)
multiplication = Multiplication(A=printer_params.ext_ratio_2, B=Slider(1.9, range=0..10))
extrusioncalculator = ExtrusionCalculator(
    A_2=multiplication,
    B=len,
    C=printer_params.ext_height_2,
    D=printer_params.ext_width_2,
    y=number_slider_3,
    A=printer_params.fillament)
number_slider_4 = Slider(2, range=0..10)
number_slider_5 = Slider(1800, range=0..10000)
printinggcode = PrintingGcode(移動スピード=move_speed, L=simplify(cluster_4.V), I=extrusioncalculator, K=print_speed)
cluster_5 = Cluster_2(endcode=cluster_3, safe_z_distance=Slider(10, range=0..10))
retraction_code = RetractionCode(retract=number_slider_4, F=number_slider_5, gcode=printinggcode)
data = Data(cluster_5)
list = SerialPorts({"cu.debug-console", "cu.JBLRACETWS", "cu.Bluetooth-Incoming-Port"}, selected="cu.debug-console")
list_2 = SerialPorts({"cu.debug-console", "cu.JBLRACETWS", "cu.Bluetooth-Incoming-Port"}, selected="cu.debug-console")

boundary = BoundarySurfaces(Edges=graft(crv))

area = Area(Geometry=boundary)  # -> Area, Centroid

cir = Circle(Plane=area.Centroid, Radius=1)
flip = FlipCurve(Curve=graft(crv), Guide=cir)  # -> Curve, flatten(Flag)

unflatten = UnflattenTree(Tree=flip.Curve, Guide=crv)
crv_2 = Curve(unflatten)

preview = CustomPreview(Geometry=crv_2, Material=ColourSwatch(SwatchColor=RGB(247, 247, 0)))

# ---- group: Outline
crv_3 = Curve(crv_2)

# ----
transform = Transform(Geometry=crv_3, Transform=move_to_center.X_2)
cluster_6 = Cluster_5(crv=transform, L=number_slider_2, S=1)  # -> simplify(S_2), V
len_2 = Length(Curve=cluster_6.S_2)
extrusioncalculator_2 = ExtrusionCalculator(
    A_2=printer_params.ext_ratio_2,
    B=len_2,
    C=printer_params.ext_height_2,
    D=printer_params.ext_width_2,
    y=number_slider_3,
    A=printer_params.fillament)
printinggcode_2 = PrintingGcode(移動スピード=move_speed, L=simplify(cluster_6.V), I=extrusioncalculator_2, K=print_speed)
retraction_code_2 = RetractionCode(retract=number_slider_4, F=number_slider_5, gcode=printinggcode_2)
entwine = Entwine(Branch00=startcode, Branch01=retraction_code, Branch02=retraction_code_2, Branch03=data, FlattenInputs=True)
flatten = FlattenTree(Tree=entwine, Path="{0}")
panel = Panel(flatten)
serial_control = SerialControl(
    Port=[list, list_2],
    BaudRate=115200,
    Connect=False,
    Command=panel,
    Reset=False,
    BoundingBox=Vector(220, 220, 250),
    ShowBBox=False,
    Samples=0)  # -> Response, PortEvent, Path, GCode

# ==== cluster Cluster
srf = ClusterInput()
srf_2 = Surface(srf)
area = Area(Geometry=srf_2)  # -> Area, Centroid
srf_cp = SurfaceClosestPoint(Point=area.Centroid, Surface=srf_2)  # -> Point, UVPoint, Distance
evalsrf = EvaluateSurface(Surface=srf_2, Point=srf_cp.UVPoint)  # -> Point, Normal, UDirection, VDirection, Frame
B = ClusterInput()
devec = DeconstructVector(Vector=evalsrf.Normal)  # -> XComponent, YComponent, ZComponent
vdis = VectorDisplay(Anchor=evalsrf.Point, Vector=evalsrf.Normal)
larger = LargerThan(FirstNumber=devec.ZComponent, SecondNumber=B)  # -> LargerThan, OrEqualTo
cull = CullPattern(List=srf_2, CullPattern=larger.OrEqualTo)
L = ClusterOutput(cull)

# ==== cluster Startcode
num = ClusterInput()
num_2 = Number(num)
concat = Concatenate(FragmentA="M109 S", FragmentB=num_2)
concat_2 = Concatenate(FragmentA="M104 S", FragmentB=num_2)
ender5 = Panel("""G21 ; Set units to milimeters
T0
G28 ; Go home
G90 ; Set to Absolute Positioning
G92 E0 ; Set to home current position
M82 ; Use absolute distances for extrusion

G1 E6 F200
M106
G1 X0 Y0 Z1.5 E0 F4500 ; go""")
atom = Panel("""G21 ; Set units to milimeters
T0
G28 ; Go home
G90 ; Set to Absolute Positioning
G92 E0 ; Set to home current position
M82 ; Use absolute distances for extrusion

G1 E6 F200
M106
G1 X0 Y0 Z1.5 E0 F4500 ; go""")
num_3 = ClusterInput()
num_4 = Number(num_3)
concat_3 = Concatenate(FragmentA="M190 S", FragmentB=num_4)
concat_4 = Concatenate(FragmentA="M140 S", FragmentB=num_4)
merge = Merge(Data1=concat_4, Data2=concat_3, Data3=concat_2, Data4=concat)
merge_2 = Merge(Data1=concat_4, Data2=concat_3, Data3=concat_2, Data4=concat)
ins = InsertItems(List=atom, Item=merge, Indices=3, Wrap=True)  # -> flatten(List)
ins_2 = InsertItems(List=ender5, Item=merge_2, Indices=3, Wrap=True)  # -> flatten(List)
G = ClusterInput()
filter = StreamFilter(Gate=G, Stream0=ins, Stream1=ins_2)
startcode = Data(filter)
startcode_2 = ClusterOutput(startcode)

# ==== cluster Cluster_2
lastpoint = ClusterInput()
lastpoint_2 = Point(lastpoint)
pdecon = Deconstruct(Point=lastpoint_2)  # -> XComponent, YComponent, ZComponent
flatten = FlattenTree(Tree=pdecon.ZComponent, Path="{0}")
lng = ListLength(List=flatten)
safe_z_distance = ClusterInput()
item = ListItem(List=flatten, Index=lng, Wrap=True)
addition = Addition(A=item, Safe_Z_distance=safe_z_distance)
endcode = ClusterInput()
endcode_2 = Data(endcode)
concat = Concatenate(FragmentA="G1 Z", FragmentB=addition, FragmentC=" F1000")
ins = InsertItems(List=endcode_2, Item=concat, Indices="0", Wrap=True)
L = ClusterOutput(ins)

# ==== cluster Cluster_3
num = ClusterInput()
num_2 = Number(num)
プリント開始高さ = Slider(0.2, range=0..10)
レイヤーピッチ = Slider(0.9, range=0..10)
number_slider = Slider(0.25, range=0..1)
x_domain = Panel("220")
y_domain = Panel("220")
z_domain = Panel("300")
rectangle = Rectangle(Plane=PlaneXY(0, 0, 0), XSize=x_domain, YSize=y_domain, Radius=0)  # -> Rectangle, Length
filter = StreamFilter(Gate=num_2, Stream1=プリント開始高さ)
filter_2 = StreamFilter(Gate=num_2, Stream1=z_domain)
filter_3 = StreamFilter(Gate=num_2, Stream1=レイヤーピッチ)
filter_4 = StreamFilter(Gate=num_2, Stream1=rectangle.Rectangle)
rec = Rectangle(filter_4)
Z = UnitZ(Factor=number_slider)
move = Move(Geometry=rec, Motion=Z)  # -> Geometry, Transform
drec = DeconstuctRectangle(Rectangle=filter_4)  # -> BasePlane, XInterval, YInterval
dedomain = DeconstructDomain(Domain=drec.XInterval)  # -> Start, End
dedomain_2 = DeconstructDomain(Domain=drec.YInterval)  # -> Start, End
division = Division(A=dedomain.End, B=2)
division_2 = Division(A=dedomain_2.End, B=2)
pt = ConstructPoint(XCoordinate=division, YCoordinate=division_2, ZCoordinate=number_slider)
pt_2 = ConstructPoint(XCoordinate=0, YCoordinate=0, ZCoordinate=0)
line = LineSDL(Start=pt_2, Direction=Vector(0, 0, 1), Length=filter_2)
line_2 = LineSDL(Start=pt, Direction=Vector(0, 0, 1), Length=filter_2)
loft = Loft(Curves=[line_2, line], Options={Adjust=False, Closed=False, LoftEnds=0, LoftSimp=0, LoftType=0, Rebuild=10, Refit=0.01})
print_start_height = ClusterOutput(filter)
layer_height = ClusterOutput(filter_3)
print_height = ClusterOutput(filter_2)
rectangle_2 = ClusterOutput(move.Geometry)
print_area = ClusterOutput(filter_4)
y_center = ClusterOutput(division_2)
x_center = ClusterOutput(division)
centerpt = ClusterOutput(pt)
seamcutter = ClusterOutput(loft)

# ==== cluster RetractionCode
F = ClusterInput()
retract = ClusterInput()
F_2 = Number(F)
retract_2 = Number(retract)
gcode = ClusterInput()
concat = Concatenate(FragmentA="G1 E-", FragmentB=retract_2, FragmentC=" F", FragmentD=F_2)
gcode_2 = Data(gcode)
concat_2 = Concatenate(FragmentA="G1 E", FragmentB="0", FragmentC=" F", FragmentD=F_2)
weave = Weave(Pattern=[0, 1, 2], Stream0="G92 E0", Stream1=concat, Stream2=gcode_2, NullGaps=False)
ins = InsertItems(List=weave, Item=concat_2, Indices="3", Wrap=True)
L = ClusterOutput(ins)

# ==== cluster PrinterParams

# ----
# Ender5
ext_width = Slider(0.24, range=0..10)
filament = Slider(1.75, range=0..250)
ext_height = Slider(0.2, range=0..10)
ext_ratio = Slider(1.2, range=0..3)

G = ClusterInput()

filter = StreamFilter(Gate=G, Stream1=ext_ratio)
filter_2 = StreamFilter(Gate=G, Stream1=ext_height)
filter_3 = StreamFilter(Gate=G, Stream1=ext_width)
filter_4 = StreamFilter(Gate=G, Stream1=filament)

ext_ratio_2 = ClusterOutput(filter)
ext_height_2 = ClusterOutput(filter_2)
ext_width_2 = ClusterOutput(filter_3)
fillament = ClusterOutput(filter_4)

# ==== cluster PrintingGcode
移動スピード = ClusterInput()
L = ClusterInput()
item = ListItem(List=L, Index="0", Wrap=True)
cull_i = CullIndex(List=L, Indices="0", Wrap=True)
pdecon = Deconstruct(Point=item)  # -> XComponent, YComponent, ZComponent
pdecon_2 = Deconstruct(Point=cull_i)  # -> XComponent, YComponent, ZComponent
I = ClusterInput()
K = ClusterInput()
concat = Concatenate(
    FragmentA="G1",
    FragmentB=" X",
    FragmentC=pdecon.XComponent,
    FragmentD=" Y",
    FragmentE=pdecon.YComponent,
    FragmentF=" Z",
    FragmentG=pdecon.ZComponent,
    FragmentJ=" F",
    FragmentK=移動スピード)  # -> simplify(Result)
concat_2 = Concatenate(
    FragmentA="G1",
    FragmentB=" X",
    FragmentC=pdecon_2.XComponent,
    FragmentD=" Y",
    FragmentE=pdecon_2.YComponent,
    FragmentF=" Z",
    FragmentG=pdecon_2.ZComponent,
    FragmentH=" E",
    FragmentI=I,
    FragmentJ=" F",
    FragmentK=K)  # -> simplify(Result)
merge = Merge(Data1=concat, Data2=concat_2)
R = ClusterOutput(merge)

# ==== cluster ExtrusionCalculator
A = ClusterInput()
A_2 = ClusterInput()
B = ClusterInput()
C = ClusterInput()
D = ClusterInput()
pi = Pi(Factor=1)
division = Division(A=A, B=2)
multiplication = Multiplication(A=pi, B=division, C=division)
multiplication_2 = Multiplication(A=A_2, B=B, C=C, D=D)
division_2 = Division(A=multiplication_2, B=multiplication)
ma = MassAddition(Input=division_2)  # -> Result, PartialResults
y = ClusterInput()
expression = Expression(x=ma.PartialResults, y=y, Expression="Round(x,y)")
R = ClusterOutput(expression)

# ==== cluster Cluster_4
ender5_end = Panel("""M104 S0 ; turn off extruder
M140 S0 ; turn off bed
G1 Y0
M84 ; disable motors""")
G = ClusterInput()
filter = StreamFilter(Gate=G, Stream1=ender5_end)
s_1 = ClusterOutput(filter)

# ==== cluster Cluster_5
crv = ClusterInput()
crv_2 = Curve(crv)
L = ClusterInput()
divlength = DivideLength(Curve=crv_2, Length=L)  # -> Points, Tangents, Parameters
S = ClusterInput()
shift = ShiftList(List=divlength.Points, Shift=S, Wrap=True)
pline = PolyLine(Vertices=shift, Closed=False)
explode = Explode(Curve=pline, Recursive=True)  # -> Segments, Vertices
S_2 = ClusterOutput(explode.Segments)
V = ClusterOutput(explode.Vertices)

# ==== cluster MoveToCenter
G = ClusterInput()
F = ClusterInput()
X = ClusterInput()
Y = ClusterInput()
Z = UnitZ(Factor=F)
area = Area(Geometry=G)  # -> Area, Centroid
pdecon = Deconstruct(Point=area.Centroid)  # -> XComponent, YComponent, ZComponent
neg = Negative(Value=Z)
pt = ConstructPoint(XCoordinate=pdecon.XComponent, YCoordinate=pdecon.YComponent, ZCoordinate=0)
pt_2 = ConstructPoint(XCoordinate=X, YCoordinate=Y, ZCoordinate=neg)
vec2pt = Vector2Pt(PointA=pt, PointB=pt_2, Unitize=False)  # -> Vector, Length
move = Move(Geometry=G, Motion=vec2pt.Vector)  # -> Geometry, Transform
G_2 = ClusterOutput(move.Geometry)
X_2 = ClusterOutput(move.Transform)
