# Grasshopper definition nonpla+top_9Gcodeの準備.gh (Grasshopper 1.0.7)
# plug-ins: Pufferfish, treesloth01

# ---- group: TypeC
brep = Brep(<brep referenced from the Rhino model>)

# ---- group: TypeA
# 1.モデルを準備
brep_2 = Brep(<brep referenced from the Rhino model>)

# ---- group: TypeB
brep_3 = Brep(<brep referenced from the Rhino model>)

# ----
# 2. 各部位の準備のため、モデルをトリミングする
debrep = DeconstructBrep(Brep=brep)  # -> Faces, Edges, Vertices
cluster = Cluster(srf=debrep.Faces, B=Slider(0.59, range=0..1))
join = BrepJoin(Breps=cluster)  # -> Breps, Closed

# ----
# 2.1 トップの面をエッジの最大高さで囲う
edges = BrepEdges(Brep=join.Breps)  # -> Naked, Interior, NonManifold
join_2 = JoinCurves(Curves=edges.Naked, Preserve=False)
explode = Explode(Curve=join_2, Recursive=True)  # -> Segments, Vertices
pdecon = Deconstruct(Point=explode.Vertices)  # -> XComponent, YComponent, ZComponent
sort = SortList(Keys=pdecon.ZComponent, ValuesA=explode.Vertices)  # -> reverse(Keys), ValuesA
item = ListItem(List=sort.Keys, Index=0, Wrap=True)
pt = ConstructPoint(XCoordinate=pdecon.XComponent, YCoordinate=pdecon.YComponent, ZCoordinate=item)
pline = PolyLine(Vertices=pt, Closed=False)

# ---- group: 底面を抽出する
cluster_2 = Cluster_2(srf=debrep.Faces)

# ----
# 2.3オフセットした内側の面を作る
neg = Negative(Value=Slider(0.3, range=0..1))
offset = OffsetCurve(Curve=pline, Distance=neg, Corners=1)
project = Project(Curve=offset, Brep=cluster_2, Direction=Vector(0, 0, 1))

# ----
# 2.2底の面を抜き出し大きめに作る
edges_2 = BrepEdges(Brep=cluster_2)  # -> Naked, Interior, NonManifold
join_3 = JoinCurves(Curves=edges_2.Naked, Preserve=False)
offset_2 = OffsetCurve(Curve=join_3, Distance=1, Corners=1)

# ----
# マシンの設定に関連したモノ
number_slider = Slider(1, range=0..1)
cluster_3 = Cluster_3(num=number_slider)  # -> x_center, y_center, centerpt, rectangle_2, print_area, print_start_height, print_height, layer_height, seamcutter
printer_params = PrinterParams(G=number_slider)  # -> ext_ratio_2, ext_height_2, ext_width_2, fillament
startcode = Startcode(num=Slider(210, range=0..240), num_3=Slider(60, range=50..100), G=Slider(1, range=0..10))
cluster_4 = Cluster_4(G=number_slider)
rec = Rectangle(cluster_3.print_area)

# ----
# 3. TopのNonPlanarの層数を決めて削る
number_of_topsurface = Slider(2, range=0..2)

# ----
# 3.1 本体-Top
number_slider_2 = Slider(0.3, range=0..1)
brep_4 = Brep(brep)
neg_2 = Negative(Value=number_slider_2)
Z = UnitZ(Factor=neg_2)
arrlinear = LinearArray(Geometry=join.Breps, Direction=Z, Count=expr("x+1", number_of_topsurface))  # -> Geometry, Transform
lastdex = LastIndex(List=arrlinear.Geometry)
item_2 = ListItem(List=arrlinear.Geometry, Index=lastdex, Wrap=True)
split = SplitBrep(Brep=brep_4, Cutter=item_2)
item_3 = ListItem(List=split, Index=Slider(1, range=0..1), Wrap=True)
merge = Merge(Data1=item_2, Data2=item_3)  # -> flatten(Result)
join_4 = BrepJoin(Breps=merge)  # -> Breps, Closed

move_to_center = MoveToCenter(G=brep, X=cluster_3.x_center, Y=cluster_3.y_center, F=Slider(0.25, range=0..1))  # -> simplify(flatten(G_2)), X_2
number_slider_3 = Slider(1, range=0..10)

# ----
# 4.1 スライスする
number_slider_4 = Slider(0.08, range=0..0.1)
pt_2 = ConstructPoint(XCoordinate=0, YCoordinate=0, ZCoordinate=number_slider_4)
Z_2 = UnitZ(Factor=1)
contour = Contour(Shape=join_4.Breps, Point=pt_2, Direction=Z_2, Distance="0.2")  # -> simplify(Contours)
series = Series(Start=0, Step=1, Count=Slider(2, range=0..10))
flatten = FlattenTree(Tree=contour, Path="{0}")
item_4 = ListItem(List=flatten, Index=series, Wrap=True)

number_slider_5 = Slider(3, range=0..10)
multiplication = Multiplication(A=printer_params.ext_ratio_2, B=Slider(1.9, range=0..10))
number_slider_6 = Slider(1500, range=0..10000)
number_slider_7 = Slider(4800, range=0..10000)
safez = Slider(4, range=0..10)
number_slider_8 = Slider(2, range=0..10)
number_slider_9 = Slider(1800, range=0..10000)
ノズル径 = Panel("0.4")

# ----
# マシンの設定に関連したモノ
number_slider_10 = Slider(1, range=0..1)
cluster_5 = Cluster_3(num=number_slider_10)  # -> x_center, y_center, centerpt, rectangle_2, print_area, print_start_height, print_height, layer_height, seamcutter
printer_params_2 = PrinterParams(G=number_slider_10)  # -> ext_ratio_2, ext_height_2, ext_width_2, fillament
startcode_2 = Startcode(num=Slider(210, range=0..240), num_3=Slider(60, range=50..100), G=Slider(1, range=0..10))
cluster_6 = Cluster_4(G=number_slider_10)

# ----
# 4.2 ボトム層のインフィルを設計する
# 偶数層と奇数層に分け、開始点をずらす
tstat = TreeStatistics(Tree=simplify(graft(item_4)))  # -> Paths, Length, Count
dpath = DeconstructPath(Branch=tstat.Paths)
mod = Modulus(A=dpath, B=2)  # -> simplify(Result)
cull = CullPattern(List=simplify(graft(item_4)), CullPattern=mod)
cull_2 = CullPattern(List=simplify(graft(item_4)), CullPattern=invert(mod))
seam = Seam(Curve=reparameterize(cull_2), Seam="0.25")
merge_2 = Merge(Data1=cull, Data2=seam)

# ----
# 新しく追加
lastptandendcode = LastPtAndEndCode()
skirt_layer = SkirtLayer(G=0, D=1, S=1)  # -> S_2, V
retractioncode = RetractionCode()
nonprintgcode = NonPrintGcode()

# ----
# カーブの下処理
number_slider_11 = Slider(1, range=0..1)
move_to_center_2 = MoveToCenter(X=0, Y=0, F=1)  # -> simplify(flatten(G_2)), X_2
cluster_7 = Cluster_5(L=number_slider_11, S=Slider(200, range=0..1000))  # -> S_2, V

# ----
# Gcodeの処理
extrusioncalculator = ExtrusionCalculator()
printinggcode = PrintingGcode()

# ----
# 2.4 スライスするモデルの分離
merge_3 = Merge(Data1=offset_2, Data2=project)  # -> flatten(Result)
merge_4 = Merge(Data1=offset, Data2=project)
merge_5 = Merge(Data1=pline, Data2=offset)
merge_6 = Merge(Data1=pline, Data2=offset_2)

# ---- group: 内側の面
loft = Loft(Curves=flatten(merge_4), Options={Adjust=True, Closed=False, LoftEnds=0, LoftSimp=0, LoftType=0, Rebuild=10, Refit=0.01})

# ---- group: 上面の縁
loft_2 = Loft(Curves=flatten(merge_5), Options={Adjust=True, Closed=False, LoftEnds=0, LoftSimp=0, LoftType=0, Rebuild=10, Refit=0.01})

# ---- group: 外側の面
loft_3 = Loft(Curves=merge_6, Options={Adjust=True, Closed=False, LoftEnds=0, LoftSimp=0, LoftType=0, Rebuild=10, Refit=0.01})

boundary = BoundarySurfaces(Edges=merge_3)

# ----
merge_7 = Merge(Data1=loft_3, Data2=loft_2, Data3=boundary, Data4=loft)  # -> flatten(Result)

# ---- group: ClosedBrepになっている必要あり
join_5 = BrepJoin(Breps=merge_7)  # -> Breps, Closed

# ---- group: Top縁用
sint = SolidIntersection(BrepsA=brep, BrepsB=join_5.Breps)

# ---- group: Top面用
sdiff = SolidDifference(BrepsA=brep, BrepsB=join_5.Breps)

# ----
# 3.3Topの縁
number_slider_12 = Slider(0.59, range=0..1)
brep_5 = Brep(sint)
debrep_2 = DeconstructBrep(Brep=brep_5)  # -> Faces, Edges, Vertices
cluster_8 = Cluster(srf=debrep_2.Faces, B=number_slider_12)
join_6 = BrepJoin(Breps=cluster_8)  # -> Breps, Closed

# ----
# 7.2 TopOutlineのNonPlanarの層を何層にするか
edges_3 = BrepEdges(Brep=join_6.Breps)  # -> Naked, Interior, NonManifold
join_7 = JoinCurves(Curves=edges_3.Naked, Preserve=False)

# ----
# 内側、外側で分ける
len = Length(Curve=join_7)
sort_2 = SortList(Keys=len, ValuesA=join_7)  # -> Keys, ValuesA
item_5 = ListItem(List=sort_2.ValuesA, Index=1, Wrap=True)
item_6 = ListItem(List=sort_2.ValuesA, Index=0, Wrap=True)

# ----
# 必要な層分の追加
merge_8 = Merge(Data1=item_6, Data2=item_5)
arrlinear_2 = LinearArray(Geometry=merge_8, Direction=Z, Count=number_of_topsurface)  # -> reverse(simplify(Geometry)), Transform
flip = FlipMatrix(Data=arrlinear_2.Geometry)

# ----
# 8.Previewを作る
swatch = ColourSwatch(SwatchColor=RGB(255, 184, 255))

# ----
# 3.2 オフセット済み本体のTop
number_slider_13 = Slider(0.59, range=0..1)
brep_6 = Brep(sdiff)
debrep_3 = DeconstructBrep(Brep=brep_6)  # -> Faces, Edges, Vertices
cluster_9 = Cluster(srf=debrep_3.Faces, B=number_slider_13)

join_8 = BrepJoin(Breps=cluster_9)  # -> Breps, Closed

arrlinear_3 = LinearArray(Geometry=join_8.Breps, Direction=Z, Count=number_of_topsurface)  # -> Geometry, Transform

# ----
# 6.Infillをつくる
# 偶数層と奇数層に分ける
brep_7 = Brep(join_4.Breps)

# ----
# ベースとなるカーブを作る
bbox = BoundingBox(Content=brep_7, Plane=PlaneXY(0, 0, 0))  # -> Box, Box_2
debrep_4 = DeconstructBrep(Brep=bbox.Box)  # -> Faces, Edges, Vertices
len_2 = Length(Curve=debrep_4.Edges)
area = Area(Geometry=debrep_4.Faces)  # -> Area, Centroid
sort_3 = SortList(Keys=len_2, ValuesA=debrep_4.Edges)  # -> reverse(Keys), ValuesA
pdecon_2 = Deconstruct(Point=area.Centroid)  # -> XComponent, YComponent, ZComponent
dcon = DeleteConsecutive(Set=sort_3.Keys, Wrap=False)  # -> Set, Count
sort_4 = SortList(Keys=pdecon_2.ZComponent, ValuesA=area.Centroid)  # -> Keys, ValuesA
neg_3 = Negative(Value="10")
item_7 = ListItem(List=dcon.Set, Index=0, Wrap=True)
item_8 = ListItem(List=dcon.Set, Index=1, Wrap=True)
pitch = Slider(2.5, range=0..10)
item_9 = ListItem(List=sort_4.ValuesA, Index=0, Wrap=True)
vec = VectorXYZ(XComponent=["10", neg_3], YComponent="10", ZComponent=0)  # -> Vector, Length
sqr = Square(Value=item_7)
sqr_2 = Square(Value=item_8)
line = LineSDL(Start=item_9, Direction=vec.Vector, Length="10")  # -> simplify(graft(Line))
addition = Addition(A=sqr, B=sqr_2)
num = Number(pitch)
sqrt = SquareRoot(Value=addition)
division = Division(A=sqrt, B=num)
series_2 = Series(Start=num, Step=num, Count=division)
neg_4 = Negative(Value=series_2)
offset_3 = OffsetCurve(Curve=line, Distance=[series_2, neg_4], Corners=1)  # -> simplify(Curve)
end = EndPoints(Curve=[offset_3, line])  # -> simplify(Start), simplify(End)
vec2pt = Vector2Pt(PointA=end.Start, PointB=end.End, Unitize=False)  # -> Vector, Length
neg_5 = Negative(Value=vec2pt.Vector)
merge_9 = Merge(Data1=vec2pt.Vector, Data2=neg_5)
project_2 = ProjectPoint(Point=simplify(end.Start), Direction=simplify(merge_9), Geometry=bbox.Box)  # -> Point, Index
item_10 = ListItem(List=project_2.Point, Index=0, Wrap=True)  # -> Item, Item1
ln = Line(StartPoint=item_10.Item, EndPoint=item_10.Item1)  # -> simplify(Line)

tstat_2 = TreeStatistics(Tree=graft(ln))  # -> simplify(Paths), Length, Count
dpath_2 = DeconstructPath(Branch=tstat_2.Paths)
item_11 = ListItem(List=dpath_2, Index=0, Wrap=True)
dispatch = Dispatch(List=ln, DispatchPattern=item_11)  # -> ListA, ListB
crv = Curve(dispatch.ListA)
crv_2 = Curve(dispatch.ListB)
clean = CleanTree(RemoveNulls=True, RemoveInvalid=True, RemoveEmpty=False, Tree=crv)
clean_2 = CleanTree(RemoveNulls=True, RemoveInvalid=True, RemoveEmpty=False, Tree=crv_2)

# ----
# 7.Non Planarを作る
number_slider_14 = Slider(0.3, range=0..0.3)
crv_3 = Curve(flip)

# ---- group: Top Outline
crv_4 = Curve(crv_3)

# ----
transform = Transform(Geometry=crv_4, Transform=move_to_center.X_2)

# ----
# 7.Non PlanarのTopを作る
X = UnitX(Factor=1)
series_3 = Series(Start=0, Step=1, Count=number_of_topsurface)
Y = UnitY(Factor=1)
weave = Weave(Pattern=series_3, Stream0=X, Stream1=Y, Stream2=X, NullGaps=False)  # -> simplify(graft(Weave))
contour_2 = Contour(Shape=simplify(graft(arrlinear_3.Geometry)), Point=Point(0, 0, 0), Direction=weave, Distance=number_slider_14)
pshift = ShiftPaths(Data=contour_2, Offset=-1)

# ----
# ノズル径の半分だけ短くする
division_2 = Division(A=ノズル径, B=2)
neg_6 = Negative(Value=division_2)
ext = ExtendCurve(Curve=pshift, Type=0, Start=neg_6, End=neg_6)

# ----
# 向きをそろえる
item_12 = ListItem(List=ext, Index=0, Wrap=True)
end_2 = EndPoints(Curve=item_12)  # -> Start, End
ln_2 = Line(StartPoint=end_2.Start, EndPoint=end_2.End)
flip_2 = FlipCurve(Curve=ext, Guide=ln_2)  # -> Curve, Flag

# ----
# 始点、終点をそれぞれずらしてつなぐ
end_3 = EndPoints(Curve=flip_2.Curve)  # -> Start, End
panel = Panel("0")
lng = ListLength(List=end_3.Start)
lng_2 = ListLength(List=end_3.End)
cull_i = CullIndex(List=end_3.Start, Indices=expr("x-1", lng), Wrap=True)
cull_i_2 = CullIndex(List=end_3.End, Indices=lng_2, Wrap=True)
cull_3 = CullPattern(List=cull_i_2, CullPattern=invert([False, True]))
cull_4 = CullPattern(List=cull_i, CullPattern=invert([False, True]))
cull_5 = CullPattern(List=cull_i_2, CullPattern=[False, True])
cull_6 = CullPattern(List=cull_i, CullPattern=[False, True])
ln_3 = Line(StartPoint=cull_5, EndPoint=cull_3)
ln_4 = Line(StartPoint=cull_6, EndPoint=cull_4)
merge_10 = Merge(Data1=flip_2.Curve, Data2=ln_4, Data3=ln_3)  # -> flatten(Result)
join_9 = JoinCurves(Curves=merge_10, Preserve=False)

panel_2 = Panel(join_9)
crv_5 = Curve(join_9)

# ---- group: Top Surface
crv_6 = Curve(crv_5)

# ----
transform_2 = Transform(Geometry=reverse(crv_6), Transform=move_to_center.X_2)  # -> simplify(graft(Geometry))
merge_11 = Merge(Data1=transform, Data2=transform_2)
cluster_10 = Cluster_5(crv=merge_11, L=number_slider_3, S=1)  # -> simplify(S_2), simplify(V)
lng_3 = ListLength(List=cluster_10.V)
weave_2 = Weave(Pattern=[0, 1], Stream0="0", Stream1=lng_3, NullGaps=False)
len_3 = Length(Curve=cluster_10.S_2)
item_13 = ListItem(List=cluster_10.V, Index=weave_2, Wrap=True)
extrusioncalculator_2 = ExtrusionCalculator(
    A_2=printer_params.ext_ratio_2,
    B=len_3,
    C=printer_params.ext_height_2,
    D=printer_params.ext_width_2,
    y=number_slider_5,
    A=printer_params.fillament)
pdecon_3 = Deconstruct(Point=item_13)  # -> XComponent, YComponent, ZComponent
addition_2 = Addition(A=pdecon_3.ZComponent, B=safez)
pt_3 = ConstructPoint(XCoordinate=pdecon_3.XComponent, YCoordinate=pdecon_3.YComponent, ZCoordinate=addition_2)
printinggcode_2 = PrintingGcode(移動スピード=number_slider_7, L=simplify(cluster_10.V), I=extrusioncalculator_2, K=number_slider_6)
cluster_11 = Cluster_7(P=pt_3, 移動スピード=number_slider_7)
# 既に習得済み
cluster_12 = Cluster_8(endcode=cluster_4, lastpoint=cluster_10.V, safe_z_distance=Slider(10, range=0..10))
lng_4 = ListLength(List=cluster_11)
retraction_code = RetractionCode_3(retract=number_slider_8, F=number_slider_9, gcode=printinggcode_2)  # -> simplify(L)
item_14 = ListItem(List=cluster_11, Index=0, Wrap=True)
item_15 = ListItem(List=cluster_11, Index=lng_4, Wrap=True)
panel_3 = Panel(retraction_code)
data = Data(cluster_12)
ins = InsertItems(List=retraction_code, Item=item_14, Indices="2", Wrap=True)
lng_5 = ListLength(List=ins)
ins_2 = InsertItems(List=ins, Item=item_15, Indices=simplify(lng_5), Wrap=True)  # -> simplify(List)

preview = CustomPreview(Geometry=[crv_6, crv_4], Material=swatch)

# ----
# 5.削ったBrepからアウトラインをつくる
tstat_3 = TreeStatistics(Tree=contour)  # -> Paths, Length, Count
cull_i_3 = CullIndex(List=tstat_3.Paths, Indices=series, Wrap=True)
split_2 = SplitTree(Data=contour, Masks=flatten(cull_i_3))  # -> Positive, Negative
crv_7 = Curve(split_2.Positive)

# ----
# 向きをそろえる
boundary_2 = BoundarySurfaces(Edges=graft(crv_7))
area_2 = Area(Geometry=boundary_2)  # -> Area, Centroid
cir = Circle(Plane=area_2.Centroid, Radius=1)
flip_3 = FlipCurve(Curve=graft(crv_7), Guide=cir)  # -> Curve, flatten(Flag)

curvepoint = PointOnCurve(crv_7, parameter=1)
curvepoint_2 = PointOnCurve(flip_3.Curve, parameter=0)

# ----
# Bottom
panel_4 = Panel("0.5")
neg_7 = Negative(Value=panel_4)

# ----
# まとめ
number_slider_15 = Slider(1, range=0..10)
xy = XYPlane(Origin=Point(0, 0, 0))
offset_4 = OffsetCurve(Curve=simplify(flip_3.Curve), Distance=neg_7, Plane=xy, Corners=number_slider_15)  # -> simplify(Curve)
unflatten = UnflattenTree(Tree=flip_3.Curve, Guide=crv_7)
unflatten_2 = UnflattenTree(Tree=offset_4, Guide=crv_7)
merge_12 = Merge(Data1=unflatten, Data2=unflatten_2)

# ----
# 4.3 クロスした点を並べる
number_slider_16 = Slider(0.7, range=0..10)
offset_5 = OffsetCurve(Curve=merge_2, Distance=neg_7, Corners=1)
lastdex_2 = LastIndex(List=offset_5)
item_16 = ListItem(List=offset_5, Index=lastdex_2, Wrap=True)
divide = DivideCurve(Curve=item_16, Count="4", Kinks=False)  # -> Points, Tangents, Parameters
lng_6 = ListLength(List=divide.Points)
division_3 = Division(A=lng_6, B="2")
item_17 = ListItem(List=divide.Points, Index=division_3, Wrap=True)
item_18 = ListItem(List=divide.Points, Index=0, Wrap=True)
ln_5 = Line(StartPoint=item_17, EndPoint=item_18)
divlength = DivideLength(Curve=ln_5, Length=number_slider_16)  # -> Points, Tangents, Parameters

crv_8 = Curve(offset_4)
crv_9 = Curve(merge_12)

# ---- group: Outline
crv_10 = Curve(crv_9)

# ----
transform_3 = Transform(Geometry=crv_10, Transform=move_to_center.X_2)
cluster_13 = Cluster_5(crv=transform_3, L=number_slider_3, S=1)  # -> simplify(S_2), V
len_4 = Length(Curve=cluster_13.S_2)
extrusioncalculator_3 = ExtrusionCalculator(
    A_2=printer_params.ext_ratio_2,
    B=len_4,
    C=printer_params.ext_height_2,
    D=printer_params.ext_width_2,
    y=number_slider_5,
    A=printer_params.fillament)
printinggcode_3 = PrintingGcode(移動スピード=number_slider_7, L=simplify(cluster_13.V), I=extrusioncalculator_3, K=number_slider_6)
retraction_code_2 = RetractionCode_3(retract=number_slider_8, F=number_slider_9, gcode=printinggcode_3)

# ---- group: アウトライン
crv_11 = Curve(crv_8)

# ----
# 高さの座標を取得
area_3 = Area(Geometry=crv_11)  # -> Area, Centroid
pdecon_4 = Deconstruct(Point=area_3.Centroid)  # -> XComponent, YComponent, ZComponent
Z_3 = UnitZ(Factor=pdecon_4.ZComponent)

# ----
# 4.4 並んだ点から内側のアウトラインまで線を引く
pl = PlaneNormal(Origin=divlength.Points, ZAxis=divlength.Tangents)
deplane = DeconstructPlane(Plane=pl)  # -> Origin, XAxis, YAxis, ZAxis
line_2 = LineSDL(Start=deplane.Origin, Direction=deplane.XAxis, Length=1)
cull_i_4 = CullIndex(List=line_2, Indices=0, Wrap=True)
end_4 = EndPoints(Curve=simplify(cull_i_4))  # -> graft(Start), graft(End)
vec2pt_2 = Vector2Pt(PointA=end_4.Start, PointB=end_4.End, Unitize=False)  # -> Vector, Length
neg_8 = Negative(Value=vec2pt_2.Vector)
project_3 = ProjectPoint(Point=end_4.Start, Direction=[vec2pt_2.Vector, neg_8], Geometry=simplify(flatten(item_16)))  # -> Point, Index
item_19 = ListItem(List=project_3.Point, Index=0, Wrap=True)  # -> Item, Item1
ln_6 = Line(StartPoint=item_19.Item, EndPoint=item_19.Item1)

# ----
# 階層の最初の番号を取得
tstat_4 = TreeStatistics(Tree=Z_3)  # -> Paths, Length, Count
split_3 = TextSplit(Text=tstat_4.Paths, Separators="{;")
item_20 = ListItem(List=split_3, Index="1", Wrap=True)  # -> simplify(flatten(Item))

# ----
# 4.5 内側の底面のアウトラインを点でカット
end_5 = EndPoints(Curve=simplify(ln_5))  # -> Start, End
pshift_2 = ShiftPaths(Data=project_3.Point, Offset=-1)
merge_13 = Merge(Data1=pshift_2, Data2=end_5.Start, Data3=end_5.End)
crv_cp = CurveClosestPoint(Point=merge_13, Curve=simplify(item_16))  # -> Point, Parameter, Distance
shatter = Shatter(Curve=item_16, Parameters=crv_cp.Parameter)  # -> simplify(Segments)

# ----
# 4.6 まとめ
pshift_3 = ShiftPaths(Data=ln_6, Offset=-1)
cull_7 = CullPattern(List=shatter, CullPattern=[False, True])
merge_14 = Merge(Data1=cull_7, Data2=pshift_3)
join_10 = JoinCurves(Curves=merge_14, Preserve=False)
merge_15 = Merge(Data1=merge_2, Data2=simplify(offset_5), Data3=simplify(join_10))

# ---- group: Bottom
crv_12 = Curve(merge_15)

# ----
transform_4 = Transform(Geometry=crv_12, Transform=move_to_center.X_2)
item_21 = ListItem(List=flatten(transform_4), Index=0, Wrap=True)
cluster_14 = Cluster_6(
    flip=Slider(0, range=0..1),
    firstlayer=item_21,
    offset=Slider(6, range=0..10),
    pitch=number_slider_3,
    startposition=Slider(0, range=0..74))  # -> S, V
cluster_15 = Cluster_5(crv=transform_4, L=number_slider_3, S=1)  # -> simplify(S_2), V
len_5 = Length(Curve=cluster_15.S_2)
len_6 = Length(Curve=cluster_14.S)
extrusioncalculator_4 = ExtrusionCalculator(
    A_2=multiplication,
    B=len_5,
    C=printer_params.ext_height_2,
    D=printer_params.ext_width_2,
    y=number_slider_5,
    A=printer_params.fillament)
extrusioncalculator_5 = ExtrusionCalculator(
    A_2=multiplication,
    B=len_6,
    C=printer_params.ext_height_2,
    D=printer_params.ext_width_2,
    y=number_slider_5,
    A=printer_params.fillament)
printinggcode_4 = PrintingGcode(移動スピード=number_slider_7, L=cluster_14.V, I=extrusioncalculator_5, K=number_slider_6)
printinggcode_5 = PrintingGcode(移動スピード=number_slider_7, L=simplify(cluster_15.V), I=extrusioncalculator_4, K=number_slider_6)
retraction_code_3 = RetractionCode_2(retract=number_slider_8, F=number_slider_9, gcode=printinggcode_5)
panel_5 = Panel(join_10)

crv_13 = Curve(merge_15)
panel_6 = Panel(merge_15)

preview_2 = CustomPreview(Geometry=crv_10, Material=ColourSwatch(SwatchColor=RGB(247, 247, 0)))
preview_3 = CustomPreview(Geometry=crv_12, Material=ColourSwatch(SwatchColor=RGB(0, 125, 247)))

line_3 = Line(flatten(clean))
line_4 = Line(flatten(clean_2))

# ----
# 階層の番号が偶数か奇数かで仕分ける
clone = CloneStructure(List=item_20, Structure=tstat_4.Paths)
mod_2 = Modulus(A=clone, B=2)
cull_8 = CullPattern(List=Z_3, CullPattern=mod_2)
cull_9 = CullPattern(List=Z_3, CullPattern=invert(mod_2))
move = Move(Geometry=line_3, Motion=cull_8)  # -> Geometry, Transform
move_2 = Move(Geometry=line_4, Motion=cull_9)  # -> Geometry, Transform

# ----
# インフィルのアウトラインをカットする
crv_14 = Curve(move_2.Geometry)
crv_15 = Curve(move.Geometry)
trim = TrimWithRegions(Curve=crv_15, Regions=crv_11)  # -> Inside, Outside
trim_2 = TrimWithRegions(Curve=crv_14, Regions=crv_11)  # -> Inside, Outside
crv_16 = Curve(trim.Inside)
crv_17 = Curve(trim_2.Inside)
pshift_4 = ShiftPaths(Data=crv_16, Offset=-1)
pshift_5 = ShiftPaths(Data=crv_17, Offset=-1)
ccx = CurveCurve(CurveA=crv_11, CurveB=pshift_4)  # -> Points, ParamsA, ParamsB
ccx_2 = CurveCurve(CurveA=crv_11, CurveB=pshift_5)  # -> Points, ParamsA, ParamsB
pshift_6 = ShiftPaths(Data=ccx.ParamsA, Offset=-1)
pshift_7 = ShiftPaths(Data=ccx_2.ParamsA, Offset=-1)
shatter_2 = Shatter(Curve=crv_11, Parameters=pshift_6)
shatter_3 = Shatter(Curve=crv_11, Parameters=pshift_7)

midpt = CurveMiddle(Curve=shatter_3)
cir_2 = Circle(Plane=area_3.Centroid, Radius=1)
alongcrv = SortAlongCurve(Points=simplify(midpt), Curve=cir_2)  # -> Points, Indices
item_22 = ListItem(List=shatter_3, Index=alongcrv.Indices, Wrap=True)

# ----
# リストの最初のカーブがインフィルの一本目の線分で切られたものになる
end_6 = EndPoints(Curve=flatten(pshift_5))  # -> Start, End
pdecon_5 = Deconstruct(Point=end_6.Start)  # -> XComponent, YComponent, ZComponent
bnd = Bounds(Numbers=flatten(pdecon_5.XComponent))
dedomain = DeconstructDomain(Domain=bnd)  # -> Start, End
pt_4 = ConstructPoint(XCoordinate=dedomain.End, YCoordinate=0, ZCoordinate=0)
cp = ClosestPoint(Point=pt_4, Cloud=alongcrv.Points)  # -> ClosestPoint, CPIndex, Distance
shift = ShiftList(List=item_22, Shift=cp.CPIndex, Wrap=True)  # -> simplify(List)

# ----
# 外周のカーブの向きをそろえる
midpt_2 = CurveMiddle(Curve=shatter_2)
cir_3 = Circle(Plane=area_3.Centroid, Radius=1)
alongcrv_2 = SortAlongCurve(Points=simplify(midpt_2), Curve=cir_3)  # -> Points, Indices
item_23 = ListItem(List=shatter_2, Index=alongcrv_2.Indices, Wrap=True)

# ----
# リストの最初のカーブがインフィルの一本目の線分で切られたものになる
end_7 = EndPoints(Curve=flatten(pshift_4))  # -> Start, End
pdecon_6 = Deconstruct(Point=end_7.Start)  # -> XComponent, YComponent, ZComponent
bnd_2 = Bounds(Numbers=flatten(pdecon_6.XComponent))
dedomain_2 = DeconstructDomain(Domain=bnd_2)  # -> Start, End
pt_5 = ConstructPoint(XCoordinate=dedomain_2.Start, YCoordinate=0, ZCoordinate=0)
cp_2 = ClosestPoint(Point=pt_5, Cloud=alongcrv_2.Points)  # -> ClosestPoint, CPIndex, Distance
shift_2 = ShiftList(List=item_23, Shift=cp_2.CPIndex, Wrap=True)  # -> simplify(List)

# ----
# 線分の数が奇数個か偶数個かで処理を変える
lng_7 = ListLength(List=shift_2)
division_4 = Division(A=lng_7, B=2)
mod_3 = Modulus(A=division_4, B=2)
equals = Equality(FirstNumber=mod_3, SecondNumber="0")  # -> Equality, Inequality
addition_3 = Addition(A=division_4, B=equals.Equality)
split_4 = SplitList(List=shift_2, Index=addition_3)  # -> ListA, ListB
cull_10 = CullPattern(List=split_4.ListA, CullPattern=[True, False])  # -> simplify(List)
cull_11 = CullPattern(List=split_4.ListB, CullPattern=[True, False])  # -> simplify(List)
crv_18 = Curve(pshift_4)

# ----
# 線分の数が奇数個か偶数個かで処理を変える
lng_8 = ListLength(List=shift)
division_5 = Division(A=lng_8, B=2)
mod_4 = Modulus(A=division_5, B=2)
equals_2 = Equality(FirstNumber=mod_4, SecondNumber="0")  # -> Equality, Inequality
addition_4 = Addition(A=division_5, B=equals_2.Equality)
split_5 = SplitList(List=shift, Index=addition_4)  # -> ListA, ListB
cull_12 = CullPattern(List=split_5.ListA, CullPattern=[True, False])  # -> simplify(List)
cull_13 = CullPattern(List=split_5.ListB, CullPattern=[True, False])  # -> simplify(List)
crv_19 = Curve(pshift_5)

merge_16 = Merge(Data1=cull_10, Data2=cull_11, Data3=crv_18, Data4=cull_12, Data5=cull_13, Data6=crv_19)
join_11 = JoinCurves(Curves=merge_16, Preserve=False)  # -> simplify(Curves)

# ---- group: Infill
crv_20 = Curve(join_11)

# ----
preview_4 = CustomPreview(Geometry=crv_20, Material=ColourSwatch(SwatchColor=RGB(0, 245, 247)))

transform_5 = Transform(Geometry=crv_20, Transform=move_to_center.X_2)
cluster_16 = Cluster_5(crv=transform_5, L=number_slider_3, S=1)  # -> simplify(S_2), V
len_7 = Length(Curve=cluster_16.S_2)
extrusioncalculator_6 = ExtrusionCalculator(
    A_2=printer_params.ext_ratio_2,
    B=len_7,
    C=printer_params.ext_height_2,
    D=printer_params.ext_width_2,
    y=number_slider_5,
    A=printer_params.fillament)
printinggcode_6 = PrintingGcode(移動スピード=number_slider_7, L=simplify(cluster_16.V), I=extrusioncalculator_6, K=number_slider_6)
retraction_code_4 = RetractionCode_3(retract=number_slider_8, F=number_slider_9, gcode=printinggcode_6)  # -> simplify(L)
merge_17 = Merge(Data1=retraction_code_2, Data2=retraction_code_4)
entwine = Entwine(
    Branch00=startcode,
    Branch01=printinggcode_4,
    Branch02=retraction_code_3,
    Branch03=merge_17,
    Branch04=ins_2,
    Branch05=data,
    FlattenInputs=True)
flatten_2 = FlattenTree(Tree=entwine, Path="{0}")
panel_7 = Panel(flatten_2)

# ==== cluster Cluster
srf = ClusterInput()
srf_2 = Surface(srf)
area = Area(Geometry=srf_2)  # -> Area, Centroid
srf_cp = SurfaceClosestPoint(Point=area.Centroid, Surface=srf_2)  # -> Point, UVPoint, Distance
evalsrf = EvaluateSurface(Surface=srf_2, Point=srf_cp.UVPoint)  # -> Point, Normal, UDirection, VDirection, Frame
B = ClusterInput()
devec = DeconstructVector(Vector=evalsrf.Normal)  # -> XComponent, YComponent, ZComponent
vdis = VectorDisplay(Anchor=evalsrf.Point, Vector=evalsrf.Normal)
larger = LargerThan(FirstNumber=devec.ZComponent, SecondNumber=B)  # -> LargerThan, OrEqualTo
cull = CullPattern(List=srf_2, CullPattern=larger.OrEqualTo)
L = ClusterOutput(cull)

# ==== cluster Cluster_2
srf = ClusterInput()
srf_2 = Surface(srf)
area = Area(Geometry=srf_2)  # -> Area, Centroid
srf_cp = SurfaceClosestPoint(Point=area.Centroid, Surface=srf_2)  # -> Point, UVPoint, Distance
evalsrf = EvaluateSurface(Surface=srf_2, Point=srf_cp.UVPoint)  # -> Point, Normal, UDirection, VDirection, Frame
devec = DeconstructVector(Vector=evalsrf.Normal)  # -> XComponent, YComponent, ZComponent
vdis = VectorDisplay(Anchor=evalsrf.Point, Vector=evalsrf.Normal)
equals = Equality(FirstNumber=devec.ZComponent, SecondNumber="-1")  # -> Equality, Inequality
cull = CullPattern(List=srf_2, CullPattern=equals.Equality)
L = ClusterOutput(cull)

# ==== cluster Startcode
num = ClusterInput()
num_2 = Number(num)
concat = Concatenate(FragmentA="M109 S", FragmentB=num_2)
concat_2 = Concatenate(FragmentA="M104 S", FragmentB=num_2)
ender5 = Panel("""G21 ; Set units to milimeters
T0
G28 ; Go home
G90 ; Set to Absolute Positioning
G92 E0 ; Set to home current position
M82 ; Use absolute distances for extrusion

G1 E6 F200
M106
G1 X0 Y0 Z1.5 E0 F4500 ; go""")
atom = Panel("""G21 ; Set units to milimeters
T0
G28 ; Go home
G90 ; Set to Absolute Positioning
G92 E0 ; Set to home current position
M82 ; Use absolute distances for extrusion

G1 E6 F200
M106
G1 X0 Y0 Z1.5 E0 F4500 ; go""")
num_3 = ClusterInput()
num_4 = Number(num_3)
concat_3 = Concatenate(FragmentA="M190 S", FragmentB=num_4)
concat_4 = Concatenate(FragmentA="M140 S", FragmentB=num_4)
merge = Merge(Data1=concat_4, Data2=concat_3, Data3=concat_2, Data4=concat)
merge_2 = Merge(Data1=concat_4, Data2=concat_3, Data3=concat_2, Data4=concat)
ins = InsertItems(List=atom, Item=merge, Indices=3, Wrap=True)  # -> flatten(List)
ins_2 = InsertItems(List=ender5, Item=merge_2, Indices=3, Wrap=True)  # -> flatten(List)
G = ClusterInput()
filter = StreamFilter(Gate=G, Stream0=ins, Stream1=ins_2)
startcode = Data(filter)
startcode_2 = ClusterOutput(startcode)

# ==== cluster Cluster_3
num = ClusterInput()
num_2 = Number(num)

# ----
# Ender5
プリント開始高さ = Slider(0.2, range=0..10)
レイヤーピッチ = Slider(0.9, range=0..10)
x_domain = Panel("220")
y_domain = Panel("220")
z_domain = Panel("300")
rectangle = Rectangle(Plane=PlaneXY(0, 0, 0), XSize=x_domain, YSize=y_domain, Radius=0)  # -> Rectangle, Length

number_slider = Slider(0.25, range=0..1)
filter = StreamFilter(Gate=num_2, Stream1=プリント開始高さ)
filter_2 = StreamFilter(Gate=num_2, Stream1=z_domain)
filter_3 = StreamFilter(Gate=num_2, Stream1=レイヤーピッチ)
filter_4 = StreamFilter(Gate=num_2, Stream1=rectangle.Rectangle)
rec = Rectangle(filter_4)
Z = UnitZ(Factor=number_slider)
move = Move(Geometry=rec, Motion=Z)  # -> Geometry, Transform
drec = DeconstuctRectangle(Rectangle=filter_4)  # -> BasePlane, XInterval, YInterval
dedomain = DeconstructDomain(Domain=drec.XInterval)  # -> Start, End
dedomain_2 = DeconstructDomain(Domain=drec.YInterval)  # -> Start, End
division = Division(A=dedomain.End, B=2)
division_2 = Division(A=dedomain_2.End, B=2)
pt = ConstructPoint(XCoordinate=division, YCoordinate=division_2, ZCoordinate=number_slider)
pt_2 = ConstructPoint(XCoordinate=0, YCoordinate=0, ZCoordinate=0)
line = LineSDL(Start=pt_2, Direction=Vector(0, 0, 1), Length=filter_2)
line_2 = LineSDL(Start=pt, Direction=Vector(0, 0, 1), Length=filter_2)
loft = Loft(Curves=[line_2, line], Options={Adjust=False, Closed=False, LoftEnds=0, LoftSimp=0, LoftType=0, Rebuild=10, Refit=0.01})
print_start_height = ClusterOutput(filter)
layer_height = ClusterOutput(filter_3)
print_height = ClusterOutput(filter_2)
rectangle_2 = ClusterOutput(move.Geometry)
print_area = ClusterOutput(filter_4)
y_center = ClusterOutput(division_2)
x_center = ClusterOutput(division)
centerpt = ClusterOutput(pt)
seamcutter = ClusterOutput(loft)

# ==== cluster PrinterParams

# ----
# Ender5
ext_width = Slider(0.24, range=0..10)
filament = Slider(1.75, range=0..250)
ext_height = Slider(0.2, range=0..10)
ext_ratio = Slider(1.2, range=0..3)

G = ClusterInput()

filter = StreamFilter(Gate=G, Stream1=ext_ratio)
filter_2 = StreamFilter(Gate=G, Stream1=ext_height)
filter_3 = StreamFilter(Gate=G, Stream1=ext_width)
filter_4 = StreamFilter(Gate=G, Stream1=filament)

ext_ratio_2 = ClusterOutput(filter)
ext_height_2 = ClusterOutput(filter_2)
ext_width_2 = ClusterOutput(filter_3)
fillament = ClusterOutput(filter_4)

# ==== cluster Cluster_4
ender5_end = Panel("""M104 S0 ; turn off extruder
M140 S0 ; turn off bed
G1 Y0
M84 ; disable motors""")
G = ClusterInput()
filter = StreamFilter(Gate=G, Stream1=ender5_end)
s_1 = ClusterOutput(filter)

# ==== cluster MoveToCenter
G = ClusterInput()
F = ClusterInput()
X = ClusterInput()
Y = ClusterInput()
Z = UnitZ(Factor=F)
area = Area(Geometry=G)  # -> Area, Centroid
pdecon = Deconstruct(Point=area.Centroid)  # -> XComponent, YComponent, ZComponent
neg = Negative(Value=Z)
pt = ConstructPoint(XCoordinate=pdecon.XComponent, YCoordinate=pdecon.YComponent, ZCoordinate=0)
pt_2 = ConstructPoint(XCoordinate=X, YCoordinate=Y, ZCoordinate=neg)
vec2pt = Vector2Pt(PointA=pt, PointB=pt_2, Unitize=False)  # -> Vector, Length
move = Move(Geometry=G, Motion=vec2pt.Vector)  # -> Geometry, Transform
G_2 = ClusterOutput(move.Geometry)
X_2 = ClusterOutput(move.Transform)

# ==== cluster Cluster_5
crv = ClusterInput()
crv_2 = Curve(crv)
L = ClusterInput()
divlength = DivideLength(Curve=crv_2, Length=L)  # -> Points, Tangents, Parameters
S = ClusterInput()
shift = ShiftList(List=divlength.Points, Shift=S, Wrap=True)
pline = PolyLine(Vertices=shift, Closed=False)
explode = Explode(Curve=pline, Recursive=True)  # -> Segments, Vertices
S_2 = ClusterOutput(explode.Segments)
V = ClusterOutput(explode.Vertices)

# ==== cluster ExtrusionCalculator
A = ClusterInput()
pi = Pi(Factor=1)
division = Division(A=A, B=2)
A_2 = ClusterInput()
B = ClusterInput()
C = ClusterInput()
D = ClusterInput()
multiplication = Multiplication(A=A_2, B=B, C=C, D=D)
multiplication_2 = Multiplication(A=pi, B=division, C=division)
division_2 = Division(A=multiplication, B=multiplication_2)
ma = MassAddition(Input=division_2)  # -> Result, PartialResults
y = ClusterInput()
expression = Expression(x=ma.PartialResults, y=y, Expression="Round(x,y)")
R = ClusterOutput(expression)

# ==== cluster PrintingGcode
移動スピード = ClusterInput()
L = ClusterInput()
item = ListItem(List=L, Index="0", Wrap=True)
cull_i = CullIndex(List=L, Indices="0", Wrap=True)
pdecon = Deconstruct(Point=item)  # -> XComponent, YComponent, ZComponent
pdecon_2 = Deconstruct(Point=cull_i)  # -> XComponent, YComponent, ZComponent
I = ClusterInput()
K = ClusterInput()
concat = Concatenate(
    FragmentA="G1",
    FragmentB=" X",
    FragmentC=pdecon.XComponent,
    FragmentD=" Y",
    FragmentE=pdecon.YComponent,
    FragmentF=" Z",
    FragmentG=pdecon.ZComponent,
    FragmentJ=" F",
    FragmentK=移動スピード)  # -> simplify(Result)
concat_2 = Concatenate(
    FragmentA="G1",
    FragmentB=" X",
    FragmentC=pdecon_2.XComponent,
    FragmentD=" Y",
    FragmentE=pdecon_2.YComponent,
    FragmentF=" Z",
    FragmentG=pdecon_2.ZComponent,
    FragmentH=" E",
    FragmentI=I,
    FragmentJ=" F",
    FragmentK=K)  # -> simplify(Result)
merge = Merge(Data1=concat, Data2=concat_2)
R = ClusterOutput(merge)

# ==== cluster LastPtAndEndCode
P = ClusterInput()
pdecon = Deconstruct(Point=P)  # -> XComponent, YComponent, ZComponent
flatten = FlattenTree(Tree=pdecon.ZComponent, Path="{0}")
lastdex = LastIndex(List=flatten)
B = ClusterInput()
item = ListItem(List=flatten, Index=lastdex, Wrap=True)
addition = Addition(A=item, B=B)
panel = Panel(addition)
concat = Concatenate(FragmentA="G1 Z", FragmentB=panel, FragmentC=" F1000")
L = ClusterInput()
ins = InsertItems(List=L, Item=concat, Indices=0, Wrap=True)
L_2 = ClusterOutput(ins)

# ==== cluster NonPrintGcode
P = ClusterInput()
pdecon = Deconstruct(Point=P)  # -> XComponent, YComponent, ZComponent
I = ClusterInput()
concat = Concatenate(
    FragmentA="G1",
    FragmentB=" X",
    FragmentC=pdecon.XComponent,
    FragmentD=" Y",
    FragmentE=pdecon.YComponent,
    FragmentF=" Z",
    FragmentG=pdecon.ZComponent,
    FragmentH=" F",
    FragmentI=I)
R = ClusterOutput(concat)

# ==== cluster RetractionCode
retract = ClusterInput()
F = ClusterInput()
retract_2 = Number(retract)
F_2 = Number(F)
gcode = ClusterInput()
concat = Concatenate(FragmentA="G1 E-", FragmentB=retract_2, FragmentC=" F", FragmentD=F_2)
gcode_2 = Data(gcode)
weave = Weave(Pattern=[0, 1, 2], Stream0="G92 E0", Stream1=concat, Stream2=gcode_2, NullGaps=False)
concat_2 = Concatenate(FragmentA="G1 E", FragmentB="0", FragmentC=" F", FragmentD=F_2)
ins = InsertItems(List=weave, Item=concat_2, Indices="3", Wrap=True)  # -> simplify(List)
L = ClusterOutput(ins)
panel = Panel(ins)

# ==== cluster SkirtLayer
C = ClusterInput()
D = ClusterInput()
offset = OffsetCurve(Curve=C, Distance=D, Corners=1)
G = ClusterInput()
flip = FlipCurve(Curve=offset)  # -> Curve, Flag
filter = StreamFilter(Gate=G, Stream0=offset, Stream1=flip.Curve)
L = ClusterInput()
divlength = DivideLength(Curve=filter, Length=L)  # -> Points, Tangents, Parameters
S = ClusterInput()
shift = ShiftList(List=divlength.Points, Shift=S, Wrap=True)
pline = PolyLine(Vertices=shift, Closed=False)
explode = Explode(Curve=pline, Recursive=True)  # -> Segments, Vertices
S_2 = ClusterOutput(explode.Segments)
V = ClusterOutput(explode.Vertices)

# ==== cluster Cluster_6
pitch = ClusterInput()
flip = ClusterInput()
startposition = ClusterInput()
firstlayer = ClusterInput()
offset = ClusterInput()
firstlayer_2 = Curve(firstlayer)
flip_2 = Number(flip)
offset_2 = Number(offset)
offset_3 = OffsetCurve(Curve=firstlayer_2, Distance=offset_2, Corners=1)
flip_3 = FlipCurve(Curve=offset_3)  # -> Curve, Flag
filter = StreamFilter(Gate=flip_2, Stream0=offset_3, Stream1=flip_3.Curve)
pitch_2 = Number(pitch)
startposition_2 = Number(startposition)
divlength = DivideLength(Curve=filter, Length=pitch_2)  # -> Points, Tangents, Parameters
shift = ShiftList(List=divlength.Points, Shift=startposition_2, Wrap=True)
pline = PolyLine(Vertices=shift, Closed=False)
explode = Explode(Curve=pline, Recursive=True)  # -> Segments, Vertices
S = ClusterOutput(explode.Segments)
V = ClusterOutput(explode.Vertices)

# ==== cluster RetractionCode_2
retract = ClusterInput()
F = ClusterInput()
gcode = ClusterInput()
F_2 = Number(F)
retract_2 = Number(retract)
concat = Concatenate(FragmentA="G1 E-", FragmentB=retract_2, FragmentC=" F", FragmentD=F_2)
gcode_2 = Data(gcode)
concat_2 = Concatenate(FragmentA="G1 E", FragmentB="0", FragmentC=" F", FragmentD=F_2)
weave = Weave(Pattern=[0, 1, 2], Stream0="G92 E0", Stream1=concat, Stream2=gcode_2, NullGaps=False)
ins = InsertItems(List=weave, Item=concat_2, Indices="3", Wrap=True)
L = ClusterOutput(ins)

# ==== cluster RetractionCode_3
F = ClusterInput()
retract = ClusterInput()
F_2 = Number(F)
retract_2 = Number(retract)
gcode = ClusterInput()
concat = Concatenate(FragmentA="G1 E-", FragmentB=retract_2, FragmentC=" F", FragmentD=F_2)
gcode_2 = Data(gcode)
concat_2 = Concatenate(FragmentA="G1 E", FragmentB="0", FragmentC=" F", FragmentD=F_2)
weave = Weave(Pattern=[0, 1, 2], Stream0="G92 E0", Stream1=concat, Stream2=gcode_2, NullGaps=False)
ins = InsertItems(List=weave, Item=concat_2, Indices="3", Wrap=True)
L = ClusterOutput(ins)

# ==== cluster Cluster_7
移動スピード = ClusterInput()
P = ClusterInput()
pdecon = Deconstruct(Point=P)  # -> XComponent, YComponent, ZComponent
concat = Concatenate(
    FragmentA="G1",
    FragmentB=" X",
    FragmentC=pdecon.XComponent,
    FragmentD=" Y",
    FragmentE=pdecon.YComponent,
    FragmentF=" Z",
    FragmentG=pdecon.ZComponent,
    FragmentJ=" F",
    FragmentK=移動スピード)  # -> simplify(Result)
R = ClusterOutput(concat)

# ==== cluster Cluster_8
safe_z_distance = ClusterInput()
lastpoint = ClusterInput()
endcode = ClusterInput()
lastpoint_2 = Point(lastpoint)
pdecon = Deconstruct(Point=lastpoint_2)  # -> XComponent, YComponent, ZComponent
flatten = FlattenTree(Tree=pdecon.ZComponent, Path="{0}")
lng = ListLength(List=flatten)
item = ListItem(List=flatten, Index=lng, Wrap=True)
addition = Addition(A=item, Safe_Z_distance=safe_z_distance)
concat = Concatenate(FragmentA="G1 Z", FragmentB=addition, FragmentC=" F1000")
endcode_2 = Data(endcode)
ins = InsertItems(List=endcode_2, Item=concat, Indices="0", Wrap=True)
L = ClusterOutput(ins)
