# Grasshopper definition photogrammetry.gh (Grasshopper 1.0.8)
# plug-ins: CRFT Tools

boolean_toggle = BooleanToggle(True)
photogrammetry = Photogrammetry(Start=False)  # -> ServerURL, ModelFile
panel = Panel(photogrammetry.ServerURL)
panel_2 = Panel(photogrammetry.ModelFile)
