# Grasshopper definition tests.gh (Grasshopper 1.0.8)
# plug-ins: CRFT Tools

number_slider = Slider(0, range=0..1)
webcam = Webcam(Enable=Toggle(False), Device=number_slider, Name="webcam")  # -> Image, RecordingPath
brep = Brep(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)
boolean_toggle = BooleanToggle(True)
mesh = Mesh(brep)
panel = Panel("/Users/jorgemuyo/Desktop/web.mov")
panel_2 = Panel(webcam.RecordingPath)
mesh_editor = MeshEditor(Mesh=mesh, Enable=False, Device=number_slider)  # -> Mesh, Status
boolean_toggle_2 = BooleanToggle(True)
sam_ui = SAMUI(FrameRate=Slider(1, range=0..1), Run=False, Preserve=Toggle(True))  # -> Status, OutputPath, Points
ply_importer = PLYImporter(Import=True)  # -> Mesh, Vertices, Colors
