# Grasshopper definition tests_for_gcode.gh (Grasshopper 1.0.8)
# plug-ins: CRFT Tools

number_slider = Slider(50, range=0..100)  # disabled
number_slider_2 = Slider(2.5, range=0..10)  # disabled
circle = Circle(Plane=PlaneXY(0, 0, 0), Radius=number_slider)  # disabled
multiplication = Multiplication(A=number_slider, B=number_slider_2)  # disabled
unit_z = UnitZ(Factor=multiplication)  # disabled
extrude = Extrude(Base=circle, Direction=unit_z)  # disabled
number_slider_3 = Slider(1, range=0..100)  # disabled
number_slider_4 = Slider(2500, range=0..10000)  # disabled
number_slider_5 = Slider(220, range=0..1000)  # disabled
number_slider_6 = Slider(5, range=0..10)  # disabled
cap_holes = CapHoles(Brep=extrude)  # disabled
slicer_settings = SlicerSettings(
    LayerHeight=number_slider_6,
    WallOffset=0.4,
    Shells=number_slider_3,
    InfillSpacing=10,
    PrintSpeed=number_slider_4,
    NozzleDiameter=0.4,
    BedWidth=number_slider_5,
    BedDepth=200,
    MaxSegmentLength=0,
    SmoothingAngle=0,
    SmoothingSamples=0)  # disabled
slice_geometry = SliceGeometry(Geometry=cap_holes, Settings=slicer_settings)  # -> Settings, Layers; disabled
shell_geometry = ShellGeometry(Settings=slice_geometry.Settings, Layers=slice_geometry.Layers)  # -> Settings, Shells, Region; disabled
g_code_generator = GCodeGenerator(Settings=shell_geometry.Settings, Shells=shell_geometry.Shells)  # disabled
panel = Panel("""G28
M203 X200 Y200 Z5 E25
M201 X3000 Y3000 Z100 E3000
M204 P2000 R2000 T2000
M205 X20 Y20 Z0.5 E10
G21
G90
G0 X160.000 Y100.000 Z0.000
G1 X159.998 Y99.729 E0.2707 F2500
G1 X159.997 Y99.639 E0.3609 F2500
G1 X159.996 Y99.459 E0.5414 F2500
G1 X159.994 Y99.278 E0.7222 F2500
G1 X159.991 Y99.097 E0.9033 F2500
G1 X159.987 Y98.915 E1.0849 F2500
G1 X159.983 Y98.734 E1.2664 F2500
G1 X159.978 Y98.552 E1.4483 F2500
G1 X159.972 Y98.370 E1.6305 F2500
G1 X159.966 Y98.187 E1.8131 F2500
G1 X159.959 Y98.005 E1.9956 F2500
G1 X159.952 Y97.822 E2.1786 F2500
G1 X159.943 Y97.639 E2.3618 F2500
G1 X159.934 Y97.456 E2.5454 F2500
G1 X159.925 Y97.272 E2.7291 F2500
G1 X159.914 Y97.089 E2.9130 F2500
G1 X159.903 Y96.905 E3.0973 F2500
G1 X159.891 Y96.720 E3.2820 F2500
G1 X159.879 Y96.536 E3.4666 F2500
G1 X159.866 Y96.352 E3.6516 F2500
G1 X159.852 Y96.167 E3.8369 F2500
G1 X159.837 Y95.982 E4.0226 F2500
G1 X159.822 Y95.797 E4.2083 F2500
G1 X159.806 Y95.611 E4.3943 F2500
G1 X159.789 Y95.426 E4.5806 F2500
G1 X159.772 Y95.240 E4.7673 F2500
G1 X159.754 Y95.054 E4.9540 F2500
G1 X159.735 Y94.868 E5.1410 F2500
G1 X159.715 Y94.682 E5.3283 F2500
G1 X159.695 Y94.495 E5.5160 F2500
G1 X159.674 Y94.309 E5.7037 F2500
G1 X159.652 Y94.122 E5.8917 F2500
G1 X159.630 Y93.935 E6.0800 F2500
G1 X159.606 Y93.748 E6.2686 F2500
G1 X159.583 Y93.561 E6.4573 F2500
G1 X159.558 Y93.373 E6.6463 F2500
G1 X159.532 Y93.186 E6.8356 F2500
G1 X159.506 Y92.998 E7.0252 F2500
G1 X159.479 Y92.810 E7.2148 F2500
G1 X159.452 Y92.622 E7.4048 F2500
G1 X159.423 Y92.434 E7.5950 F2500
G1 X159.394 Y92.246 E7.7856 F2500
G1 X159.364 Y92.058 E7.9762 F2500
G1 X159.333 Y91.869 E8.1671 F2500
G1 X159.302 Y91.681 E8.3583 F2500
G1 X159.269 Y91.492 E8.5498 F2500
G1 X159.237 Y91.303 E8.7413 F2500
G1 X159.203 Y91.114 E8.9331 F2500
G1 X159.168 Y90.925 E9.1252 F2500
G1 X159.133 Y90.736 E9.3177 F2500
G1 X159.097 Y90.547 E9.5101 F2500
G1 X159.060 Y90.358 E9.7029 F2500
G1 X159.023 Y90.169 E9.8959 F2500
G1 X158.984 Y89.979 E10.0892 F2500
G1 X158.945 Y89.790 E10.2826 F2500
G1 X158.905 Y89.600 E10.4762 F2500
G1 X158.865 Y89.411 E10.6702 F2500
G1 X158.823 Y89.221 E10.8644 F2500
G1 X158.781 Y89.031 E11.0586 F2500
G1 X158.738 Y88.842 E11.2532 F2500
G1 X158.694 Y88.652 E11.4480 F2500
G1 X158.649 Y88.462 E11.6431 F2500
G1 X158.604 Y88.272 E11.8382 F2500
G1 X158.558 Y88.082 E12.0336 F2500
G1 X158.511 Y87.892 E12.2293 F2500
G1 X158.463 Y87.702 E12.4252 F2500
G1 X158.414 Y87.512 E12.6212 F2500
G1 X158.365 Y87.322 E12.8174 F2500
G1 X158.315 Y87.133 E13.0139 F2500
G1 X158.263 Y86.943 E13.2107 F2500
G1 X158.212 Y86.753 E13.4075 F2500
G1 X158.159 Y86.563 E13.6046 F2500
G1 X158.106 Y86.373 E13.8019 F2500
G1 X158.051 Y86.183 E13.9996 F2500
G1 X157.997 Y85.993 E14.1972 F2500
G1 X157.941 Y85.803 E14.3950 F2500
G1 X157.884 Y85.613 E14.5932 F2500
G1 X157.826 Y85.423 E14.7916 F2500
G1 X157.769 Y85.234 E14.9900 F2500
G1 X157.710 Y85.044 E15.1887 F2500
G1 X157.650 Y84.854 E15.3876 F2500
G1 X157.589 Y84.665 E15.5868 F2500
G1 X157.527 Y84.475 E15.7860 F2500
G1 X157.465 Y84.286 E15.9854 F2500
G1 X157.402 Y84.096 E16.1851 F2500
G1 X157.338 Y83.907 E16.3850 F2500
G1 X157.273 Y83.718 E16.5850 F2500
G1 X157.212 Y83.541 E16.7718 F2500
G1 X157.155 Y83.377 E16.9455 F2500
G1 X157.101 Y83.226 E17.1060 F2500
G1 X157.047 Y83.075 E17.2666 F2500
G1 X156.992 Y82.924 E17.4271 F2500
G1 X156.938 Y82.773 E17.5878 F2500
G1 X156.882 Y82.622 E17.7487 F2500
G1 X156.825 Y82.471 E17.9099 F2500
G1 X156.768 Y82.320 E18.0710 F2500
G1 X156.711 Y82.169 E18.2321 F2500
G1 X156.654 Y82.019 E18.3934 F2500
G1 X156.595 Y81.868 E18.5548 F2500
G1 X156.536 Y81.718 E18.7165 F2500
G1 X156.477 Y81.567 E18.8782 F2500
G1 X156.417 Y81.417 E19.0398 F2500
G1 X156.357 Y81.267 E19.2017 F2500
G1 X156.296 Y81.117 E19.3637 F2500
G1 X156.234 Y80.967 E19.5259 F2500
G1 X156.172 Y80.817 E19.6881 F2500
G1 X156.110 Y80.667 E19.8503 F2500
G1 X156.047 Y80.517 E20.0126 F2500
G1 X155.983 Y80.368 E20.1752 F2500
G1 X155.919 Y80.219 E20.3379 F2500
G1 X155.854 Y80.069 E20.5006 F2500
G1 X155.790 Y79.920 E20.6633 F2500
G1 X155.724 Y79.771 E20.8262 F2500
G1 X155.658 Y79.622 E20.9892 F2500
G1 X155.590 Y79.473 E21.1524 F2500
G1 X155.523 Y79.324 E21.3156 F2500
G1 X155.456 Y79.176 E21.4789 F2500
G1 X155.388 Y79.027 E21.6422 F2500
G1 X155.319 Y78.879 E21.8057 F2500
G1 X155.249 Y78.731 E21.9694 F2500
G1 X155.179 Y78.583 E22.1331 F2500
G1 X155.109 Y78.435 E22.2968 F2500
G1 X155.038 Y78.287 E22.4606 F2500
G1 X154.967 Y78.140 E22.6246 F2500
G1 X154.894 Y77.992 E22.7887 F2500
G1 X154.822 Y77.845 E22.9529 F2500
G1 X154.749 Y77.698 E23.1170 F2500
G1 X154.676 Y77.551 E23.2813 F2500
G1 X154.602 Y77.404 E23.4457 F2500
G1 X154.527 Y77.258 E23.6103 F2500
G1 X154.452 Y77.111 E23.7749 F2500
G1 X154.376 Y76.965 E23.9394 F2500
G1 X154.300 Y76.819 E24.1042 F2500
G1 X154.224 Y76.673 E24.2690 F2500
G1 X154.146 Y76.527 E24.4340 F2500
G1 X154.068 Y76.382 E24.5990 F2500
G1 X153.991 Y76.236 E24.7640 F2500
G1 X153.912 Y76.091 E24.9291 F2500
G1 X153.833 Y75.946 E25.0943 F2500
G1 X153.752 Y75.801 E25.2597 F2500
G1 X153.672 Y75.657 E25.4251 F2500
G1 X153.592 Y75.512 E25.5905 F2500
G1 X153.511 Y75.368 E25.7560 F2500
G1 X153.429 Y75.224 E25.9216 F2500
G1 X153.346 Y75.081 E26.0874 F2500
G1 X153.263 Y74.937 E26.2531 F2500
G1 X153.180 Y74.793 E26.4189 F2500
G1 X153.096 Y74.650 E26.5848 F2500
G1 X153.012 Y74.507 E26.7507 F2500
G1 X152.926 Y74.365 E26.9168 F2500
G1 X152.841 Y74.222 E27.0830 F2500
G1 X152.756 Y74.080 E27.2491 F2500
G1 X152.669 Y73.938 E27.4153 F2500
G1 X152.582 Y73.796 E27.5816 F2500
G1 X152.494 Y73.655 E27.7480 F2500
G1 X152.406 Y73.514 E27.9145 F2500
G1 X152.318 Y73.372 E28.0809 F2500
G1 X152.230 Y73.231 E28.2474 F2500
G1 X152.140 Y73.091 E28.4141 F2500
G1 X152.050 Y72.951 E28.5808 F2500
G1 X151.959 Y72.811 E28.7476 F2500
G1 X151.869 Y72.671 E28.9143 F2500
G1 X151.777 Y72.531 E29.0811 F2500
G1 X151.685 Y72.392 E29.2481 F2500
G1 X151.592 Y72.253 E29.4151 F2500
G1 X151.500 Y72.114 E29.5821 F2500
G1 X151.407 Y71.975 E29.7492 F2500
G1 X151.313 Y71.837 E29.9163 F2500
G1 X151.218 Y71.699 E30.0835 F2500
G1 X151.123 Y71.562 E30.2508 F2500
G1 X151.028 Y71.424 E30.4181 F2500
G1 X150.932 Y71.287 E30.5853 F2500
G1 X150.836 Y71.150 E30.7527 F2500
G1 X150.739 Y71.013 E30.9202 F2500
G1 X150.641 Y70.877 E31.0877 F2500
G1 X150.543 Y70.741 E31.2552 F2500
G1 X150.446 Y70.605 E31.4227 F2500
G1 X150.347 Y70.470 E31.5903 F2500
G1 X150.247 Y70.335 E31.7580 F2500
G1 X150.147 Y70.200 E31.9258 F2500
G1 X150.047 Y70.066 E32.0935 F2500
G1 X149.947 Y69.931 E32.2613 F2500
G1 X149.846 Y69.797 E32.4291 F2500
G1 X149.744 Y69.664 E32.5969 F2500
G1 X149.642 Y69.531 E32.7649 F2500
G1 X149.539 Y69.398 E32.9328 F2500
G1 X149.436 Y69.265 E33.1007 F2500
G1 X149.333 Y69.132 E33.2687 F2500
G1 X149.229 Y69.000 E33.4368 F2500
G1 X149.124 Y68.869 E33.6049 F2500
G1 X149.019 Y68.738 E33.7730 F2500
G1 X148.914 Y68.606 E33.9411 F2500
G1 X148.809 Y68.475 E34.1093 F2500
G1 X148.702 Y68.345 E34.2775 F2500
G1 X148.595 Y68.215 E34.4457 F2500
G1 X148.488 Y68.086 E34.6140 F2500
G1 X148.381 Y67.956 E34.7822 F2500
G1 X148.273 Y67.827 E34.9505 F2500
G1 X148.164 Y67.698 E35.1189 F2500
G1 X148.055 Y67.570 E35.2872 F2500
G1 X147.945 Y67.442 E35.4556 F2500
G1 X147.836 Y67.315 E35.6240 F2500
G1 X147.726 Y67.187 E35.7924 F2500
G1 X147.615 Y67.060 E35.9608 F2500
G1 X147.503 Y66.934 E36.1293 F2500
G1 X147.391 Y66.808 E36.2978 F2500
G1 X147.280 Y66.682 E36.4663 F2500
G1 X147.167 Y66.556 E36.6348 F2500
G1 X147.054 Y66.431 E36.8033 F2500
G1 X146.941 Y66.307 E36.9718 F2500
G1 X146.827 Y66.183 E37.1404 F2500
G1 X146.713 Y66.058 E37.3089 F2500
G1 X146.599 Y65.935 E37.4775 F2500
G1 X146.483 Y65.811 E37.6461 F2500
G1 X146.367 Y65.689 E37.8147 F2500
G1 X146.251 Y65.567 E37.9833 F2500
G1 X146.136 Y65.444 E38.1519 F2500
G1 X146.019 Y65.322 E38.3205 F2500
G1 X145.902 Y65.201 E38.4891 F2500
G1 X145.784 Y65.081 E38.6577 F2500
G1 X145.666 Y64.960 E38.8264 F2500
G1 X145.548 Y64.840 E38.9950 F2500
G1 X145.429 Y64.720 E39.1636 F2500
G1 X145.310 Y64.601 E39.3322 F2500
G1 X145.190 Y64.482 E39.5009 F2500
G1 X145.070 Y64.364 E39.6695 F2500
G1 X144.950 Y64.245 E39.8381 F2500
G1 X144.829 Y64.128 E40.0067 F2500
G1 X144.708 Y64.010 E40.1754 F2500
G1 X144.586 Y63.894 E40.3440 F2500
G1 X144.464 Y63.778 E40.5126 F2500
G1 X144.342 Y63.661 E40.6812 F2500
G1 X144.219 Y63.545 E40.8498 F2500
G1 X144.096 Y63.430 E41.0184 F2500
G1 X143.972 Y63.316 E41.1869 F2500
G1 X143.848 Y63.202 E41.3555 F2500
G1 X143.725 Y63.087 E41.5241 F2500
G1 X143.600 Y62.974 E41.6926 F2500
G1 X143.475 Y62.861 E41.8611 F2500
G1 X143.349 Y62.749 E42.0296 F2500
G1 X143.223 Y62.637 E42.1981 F2500
G1 X143.098 Y62.524 E42.3666 F2500
G1 X142.971 Y62.413 E42.5351 F2500
G1 X142.845 Y62.302 E42.7035 F2500
G1 X142.717 Y62.192 E42.8719 F2500
G1 X142.589 Y62.082 E43.0403 F2500
G1 X142.462 Y61.972 E43.2087 F2500
G1 X142.334 Y61.863 E43.3771 F2500
G1 X142.205 Y61.755 E43.5454 F2500
G1 X142.076 Y61.647 E43.7137 F2500
G1 X141.947 Y61.539 E43.8820 F2500
G1 X141.817 Y61.431 E44.0502 F2500
G1 X141.687 Y61.324 E44.2185 F2500
G1 X141.557 Y61.218 E44.3867 F2500
G1 X141.426 Y61.113 E44.5548 F2500
G1 X141.295 Y61.007 E44.7230 F2500
G1 X141.164 Y60.902 E44.8911 F2500
G1 X141.033 Y60.797 E45.0592 F2500
G1 X140.901 Y60.693 E45.2272 F2500
G1 X140.768 Y60.590 E45.3952 F2500
G1 X140.635 Y60.487 E45.5632 F2500
G1 X140.503 Y60.384 E45.7312 F2500
G1 X140.370 Y60.281 E45.8991 F2500
G1 X140.236 Y60.180 E46.0670 F2500
G1 X140.102 Y60.079 E46.2348 F2500
G1 X139.968 Y59.978 E46.4026 F2500
G1 X139.834 Y59.877 E46.5704 F2500
G1 X139.699 Y59.777 E46.7381 F2500
G1 X139.564 Y59.678 E46.9057 F2500
G1 X139.428 Y59.580 E47.0733 F2500
G1 X139.293 Y59.481 E47.2409 F2500
G1 X139.157 Y59.383 E47.4085 F2500
G1 X139.021 Y59.285 E47.5760 F2500
G1 X138.884 Y59.188 E47.7434 F2500
G1 X138.747 Y59.092 E47.9108 F2500
G1 X138.610 Y58.996 E48.0781 F2500
G1 X138.473 Y58.900 E48.2455 F2500
G1 X138.335 Y58.805 E48.4127 F2500
G1 X138.197 Y58.711 E48.5799 F2500
G1 X138.059 Y58.617 E48.7470 F2500
G1 X137.921 Y58.524 E48.9141 F2500
G1 X137.782 Y58.430 E49.0812 F2500
G1 X137.643 Y58.338 E49.2482 F2500
G1 X137.504 Y58.246 E49.4151 F2500
G1 X137.364 Y58.155 E49.5819 F2500
G1 X137.224 Y58.064 E49.7487 F2500
G1 X137.085 Y57.972 E49.9156 F2500
G1 X136.944 Y57.882 E50.0823 F2500
G1 X136.804 Y57.793 E50.2489 F2500
G1 X136.663 Y57.704 E50.4154 F2500
G1 X136.522 Y57.616 E50.5819 F2500
G1 X136.381 Y57.527 E50.7484 F2500
G1 X136.239 Y57.439 E50.9148 F2500
G1 X136.098 Y57.353 E51.0811 F2500
G1 X135.955 Y57.266 E51.2473 F2500
G1 X135.813 Y57.180 E51.4135 F2500
G1 X135.671 Y57.094 E51.5797 F2500
G1 X135.528 Y57.009 E51.7458 F2500
G1 X135.385 Y56.925 E51.9117 F2500
G1 X135.242 Y56.841 E52.0776 F2500
G1 X135.099 Y56.758 E52.2434 F2500
G1 X134.956 Y56.674 E52.4093 F2500
G1 X134.812 Y56.592 E52.5750 F2500
G1 X134.668 Y56.510 E52.7406 F2500
G1 X134.524 Y56.429 E52.9061 F2500
G1 X134.379 Y56.348 E53.0715 F2500
G1 X134.235 Y56.267 E53.2370 F2500
G1 X134.090 Y56.187 E53.4024 F2500
G1 X133.945 Y56.108 E53.5676 F2500
G1 X133.800 Y56.030 E53.7327 F2500
G1 X133.655 Y55.951 E53.8978 F2500
G1 X133.509 Y55.873 E54.0629 F2500
G1 X133.364 Y55.795 E54.2278 F2500
G1 X133.218 Y55.719 E54.3926 F2500
G1 X133.072 Y55.643 E54.5573 F2500
G1 X132.925 Y55.567 E54.7220 F2500
G1 X132.779 Y55.492 E54.8867 F2500
G1 X132.633 Y55.417 E55.0512 F2500
G1 X132.486 Y55.343 E55.2156 F2500
G1 X132.339 Y55.270 E55.3798 F2500
G1 X132.192 Y55.196 E55.5441 F2500
G1 X132.045 Y55.123 E55.7083 F2500
G1 X131.897 Y55.051 E55.8724 F2500
G1 X131.750 Y54.980 E56.0364 F2500
G1 X131.602 Y54.909 E56.2002 F2500
G1 X131.454 Y54.838 E56.3640 F2500
G1 X131.306 Y54.768 E56.5278 F2500
G1 X131.158 Y54.698 E56.6914 F2500
G1 X131.010 Y54.630 E56.8549 F2500
G1 X130.861 Y54.562 E57.0182 F2500
G1 X130.713 Y54.494 E57.1815 F2500
G1 X130.564 Y54.426 E57.3449 F2500
G1 X130.415 Y54.359 E57.5080 F2500
G1 X130.266 Y54.293 E57.6710 F2500
G1 X130.117 Y54.227 E57.8339 F2500
G1 X129.968 Y54.162 E57.9967 F2500
G1 X129.819 Y54.097 E58.1595 F2500
G1 X129.670 Y54.032 E58.3222 F2500
G1 X129.520 Y53.969 E58.4847 F2500
G1 X129.370 Y53.906 E58.6470 F2500
G1 X129.221 Y53.844 E58.8093 F2500
G1 X129.071 Y53.781 E58.9717 F2500
G1 X128.921 Y53.719 E59.1338 F2500
G1 X128.771 Y53.658 E59.2958 F2500
G1 X128.620 Y53.598 E59.4576 F2500
G1 X128.470 Y53.538 E59.6194 F2500
G1 X128.320 Y53.478 E59.7812 F2500
G1 X128.170 Y53.419 E59.9428 F2500
G1 X128.019 Y53.361 E60.1042 F2500
G1 X127.868 Y53.303 E60.2655 F2500
G1 X127.718 Y53.246 E60.4267 F2500
G1 X127.567 Y53.189 E60.5880 F2500
G1 X127.416 Y53.132 E60.7491 F2500
G1 X127.265 Y53.077 E60.9099 F2500
G1 X127.114 Y53.022 E61.0706 F2500
G1 X126.963 Y52.967 E61.2313 F2500
G1 X126.812 Y52.912 E61.3920 F2500
G1 X126.661 Y52.858 E61.5525 F2500
G1 X126.510 Y52.805 E61.7128 F2500
G1 X126.358 Y52.753 E61.8729 F2500
G1 X126.207 Y52.701 E62.0330 F2500
G1 X126.055 Y52.649 E62.1931 F2500
G1 X125.891 Y52.594 E62.3663 F2500
G1 X125.714 Y52.535 E62.5525 F2500
G1 X125.525 Y52.473 E62.7519 F2500
G1 X125.335 Y52.411 E62.9513 F2500
G1 X125.146 Y52.350 E63.1504 F2500
G1 X124.956 Y52.291 E63.3493 F2500
G1 X124.766 Y52.232 E63.5479 F2500
G1 X124.577 Y52.173 E63.7465 F2500
G1 X124.387 Y52.116 E63.9448 F2500
G1 X124.197 Y52.059 E64.1429 F2500
G1 X124.007 Y52.004 E64.3407 F2500
G1 X123.817 Y51.948 E64.5385 F2500
G1 X123.627 Y51.894 E64.7361 F2500
G1 X123.437 Y51.841 E64.9334 F2500
G1 X123.247 Y51.788 E65.1304 F2500
G1 X123.057 Y51.736 E65.3274 F2500
G1 X122.867 Y51.685 E65.5241 F2500
G1 X122.678 Y51.635 E65.7205 F2500
G1 X122.488 Y51.586 E65.9167 F2500
G1 X122.298 Y51.537 E66.1129 F2500
G1 X122.108 Y51.489 E66.3088 F2500
G1 X121.918 Y51.442 E66.5044 F2500
G1 X121.728 Y51.396 E66.6997 F2500
G1 X121.538 Y51.351 E66.8950 F2500
G1 X121.348 Y51.306 E67.0901 F2500
G1 X121.158 Y51.262 E67.2848 F2500
G1 X120.969 Y51.220 E67.4793 F2500
G1 X120.779 Y51.177 E67.6737 F2500
G1 X120.589 Y51.135 E67.8679 F2500
G1 X120.400 Y51.095 E68.0617 F2500
G1 X120.210 Y51.055 E68.2553 F2500
G1 X120.021 Y51.016 E68.4489 F2500
G1 X119.831 Y50.977 E68.6421 F2500
G1 X119.642 Y50.940 E68.8351 F2500
G1 X119.453 Y50.903 E69.0278 F2500
G1 X119.264 Y50.867 E69.2204 F2500
G1 X119.075 Y50.831 E69.4128 F2500
G1 X118.886 Y50.797 E69.6048 F2500
G1 X118.697 Y50.764 E69.7966 F2500
G1 X118.508 Y50.730 E69.9883 F2500
G1 X118.319 Y50.698 E70.1798 F2500
G1 X118.131 Y50.667 E70.3709 F2500
G1 X117.942 Y50.636 E70.5617 F2500
G1 X117.754 Y50.606 E70.7525 F2500
G1 X117.566 Y50.577 E70.9430 F2500
G1 X117.378 Y50.548 E71.1332 F2500
G1 X117.190 Y50.521 E71.3231 F2500
G1 X117.002 Y50.494 E71.5129 F2500
G1 X116.814 Y50.467 E71.7025 F2500
G1 X116.627 Y50.442 E71.8917 F2500
G1 X116.439 Y50.418 E72.0806 F2500
G1 X116.252 Y50.394 E72.2695 F2500
G1 X116.065 Y50.370 E72.4581 F2500
G1 X115.878 Y50.348 E72.6463 F2500
G1 X115.691 Y50.326 E72.8342 F2500
G1 X115.505 Y50.305 E73.0221 F2500
G1 X115.318 Y50.285 E73.2097 F2500
G1 X115.132 Y50.265 E73.3970 F2500
G1 X114.946 Y50.247 E73.5839 F2500
G1 X114.760 Y50.228 E73.7708 F2500
G1 X114.574 Y50.211 E73.9574 F2500
G1 X114.389 Y50.194 E74.1437 F2500
G1 X114.203 Y50.178 E74.3296 F2500
G1 X114.018 Y50.163 E74.5155 F2500
G1 X113.833 Y50.148 E74.7011 F2500
G1 X113.648 Y50.134 E74.8864 F2500
G1 X113.464 Y50.122 E75.0713 F2500
G1 X113.279 Y50.109 E75.2562 F2500
G1 X113.095 Y50.097 E75.4407 F2500
G1 X112.911 Y50.086 E75.6249 F2500
G1 X112.728 Y50.076 E75.8088 F2500
G1 X112.544 Y50.066 E75.9927 F2500
G1 X112.361 Y50.057 E76.1762 F2500
G1 X112.178 Y50.048 E76.3594 F2500
G1 X111.995 Y50.041 E76.5422 F2500
G1 X111.813 Y50.034 E76.7251 F2500
G1 X111.630 Y50.027 E76.9076 F2500
G1 X111.448 Y50.022 E77.0897 F2500
G1 X111.266 Y50.017 E77.2715 F2500
G1 X111.085 Y50.013 E77.4533 F2500
G1 X110.903 Y50.009 E77.6347 F2500
G1 X110.722 Y50.006 E77.8158 F2500
G1 X110.541 Y50.004 E77.9965 F2500
G1 X110.361 Y50.002 E78.1772 F2500
G1 X110.180 Y50.001 E78.3578 F2500
G1 X110.000 Y50.001 E78.5382 F2500
G1 X109.820 Y50.002 E78.7185 F2500
G1 X109.639 Y50.002 E78.8987 F2500
G1 X109.459 Y50.004 E79.0793 F2500
G1 X109.278 Y50.006 E79.2602 F2500
G1 X109.097 Y50.009 E79.4415 F2500
G1 X108.915 Y50.013 E79.6227 F2500
G1 X108.734 Y50.017 E79.8043 F2500
G1 X108.552 Y50.022 E79.9863 F2500
G1 X108.370 Y50.028 E80.1686 F2500
G1 X108.187 Y50.034 E80.3509 F2500
G1 X108.005 Y50.041 E80.5336 F2500
G1 X107.822 Y50.048 E80.7166 F2500
G1 X107.639 Y50.057 E80.8999 F2500
G1 X107.456 Y50.066 E81.0833 F2500
G1 X107.272 Y50.075 E81.2670 F2500
G1 X107.089 Y50.086 E81.4510 F2500
G1 X106.905 Y50.097 E81.6354 F2500
G1 X106.721 Y50.109 E81.8198 F2500
G1 X106.536 Y50.121 E82.0046 F2500
G1 X106.352 Y50.134 E82.1896 F2500
G1 X106.167 Y50.149 E82.3750 F2500
G1 X105.982 Y50.163 E82.5605 F2500
G1 X105.797 Y50.178 E82.7462 F2500
G1 X105.611 Y50.194 E82.9323 F2500
G1 X105.426 Y50.211 E83.1187 F2500
G1 X105.240 Y50.228 E83.3052 F2500
G1 X105.054 Y50.246 E83.4919 F2500
G1 X104.868 Y50.265 E83.6790 F2500
G1 X104.682 Y50.285 E83.8664 F2500
G1 X104.495 Y50.305 E84.0539 F2500
G1 X104.309 Y50.326 E84.2416 F2500
G1 X104.122 Y50.348 E84.4297 F2500
G1 X103.935 Y50.371 E84.6181 F2500
G1 X103.748 Y50.394 E84.8065 F2500
G1 X103.561 Y50.417 E84.9952 F2500
G1 X103.373 Y50.442 E85.1843 F2500
G1 X103.186 Y50.468 E85.3737 F2500
G1 X102.998 Y50.494 E85.5631 F2500
G1 X102.810 Y50.521 E85.7528 F2500
G1 X102.622 Y50.548 E85.9428 F2500
G1 X102.434 Y50.577 E86.1331 F2500
G1 X102.246 Y50.606 E86.3235 F2500
G1 X102.058 Y50.636 E86.5141 F2500
G1 X101.869 Y50.667 E86.7051 F2500
G1 X101.681 Y50.698 E86.8964 F2500
G1 X101.492 Y50.730 E87.0877 F2500
G1 X101.303 Y50.763 E87.2792 F2500
G1 X101.114 Y50.797 E87.4711 F2500
G1 X100.925 Y50.832 E87.6634 F2500
G1 X100.736 Y50.867 E87.8556 F2500
G1 X100.547 Y50.903 E88.0481 F2500
G1 X100.358 Y50.940 E88.2409 F2500
G1 X100.169 Y50.978 E88.4340 F2500
G1 X99.979 Y51.016 E88.6271 F2500
G1 X99.790 Y51.055 E88.8205 F2500
G1 X99.600 Y51.095 E89.0143 F2500
G1 X99.411 Y51.136 E89.2083 F2500
G1 X99.221 Y51.177 E89.4023 F2500
G1 X99.031 Y51.219 E89.5966 F2500
G1 X98.842 Y51.262 E89.7912 F2500
G1 X98.652 Y51.306 E89.9861 F2500
G1 X98.462 Y51.351 E90.1810 F2500
G1 X98.272 Y51.396 E90.3761 F2500
G1 X98.082 Y51.442 E90.5716 F2500
G1 X97.892 Y51.490 E90.7674 F2500
G1 X97.702 Y51.537 E90.9631 F2500
G1 X97.512 Y51.586 E91.1591 F2500
G1 X97.322 Y51.635 E91.3554 F2500
G1 X97.133 Y51.686 E91.5520 F2500
G1 X96.943 Y51.736 E91.7486 F2500
G1 X96.753 Y51.788 E91.9455 F2500
G1 X96.563 Y51.841 E92.1426 F2500
G1 X96.373 Y51.894 E92.3400 F2500
G1 X96.183 Y51.948 E92.5374 F2500
G1 X95.993 Y52.003 E92.7351 F2500
G1 X95.803 Y52.059 E92.9331 F2500
G1 X95.613 Y52.116 E93.1313 F2500
G1 X95.423 Y52.173 E93.3295 F2500
G1 X95.234 Y52.231 E93.5280 F2500
G1 X95.044 Y52.291 E93.7267 F2500
G1 X94.854 Y52.351 E93.9257 F2500
G1 X94.665 Y52.411 E94.1247 F2500
G1 X94.475 Y52.472 E94.3239 F2500
G1 X94.286 Y52.535 E94.5234 F2500
G1 X94.096 Y52.598 E94.7232 F2500
G1 X93.907 Y52.662 E94.9229 F2500
G1 X93.730 Y52.722 E95.1096 F2500
G1 X93.566 Y52.779 E95.2831 F2500
G1 X93.415 Y52.832 E95.4435 F2500
G1 X93.264 Y52.886 E95.6039 F2500
G1 X93.112 Y52.939 E95.7643 F2500
G1 X92.961 Y52.994 E95.9249 F2500
G1 X92.810 Y53.049 E96.0856 F2500
G1 X92.659 Y53.105 E96.2466 F2500
G1 X92.509 Y53.161 E96.4076 F2500
G1 X92.358 Y53.217 E96.5686 F2500
G1 X92.207 Y53.274 E96.7297 F2500
G1 X92.056 Y53.332 E96.8911 F2500
G1 X91.906 Y53.391 E97.0526 F2500
G1 X91.755 Y53.449 E97.2141 F2500
G1 X91.605 Y53.508 E97.3756 F2500
G1 X91.455 Y53.567 E97.5373 F2500
G1 X91.304 Y53.628 E97.6992 F2500
G1 X91.154 Y53.689 E97.8613 F2500
G1 X91.004 Y53.751 E98.0234 F2500
G1 X90.854 Y53.812 E98.1854 F2500
G1 X90.704 Y53.874 E98.3477 F2500
G1 X90.555 Y53.937 E98.5101 F2500
G1 X90.405 Y54.001 E98.6726 F2500
G1 X90.256 Y54.065 E98.8352 F2500
G1 X90.106 Y54.129 E98.9978 F2500
G1 X89.957 Y54.194 E99.1606 F2500
G1 X89.808 Y54.260 E99.3235 F2500
G1 X89.659 Y54.326 E99.4866 F2500
G1 X89.510 Y54.393 E99.6496 F2500
G1 X89.361 Y54.459 E99.8127 F2500
G1 X89.213 Y54.527 E99.9760 F2500
G1 X89.064 Y54.595 E100.1394 F2500
G1 X88.916 Y54.664 E100.3029 F2500
G1 X88.768 Y54.734 E100.4665 F2500
G1 X88.620 Y54.803 E100.6301 F2500
G1 X88.472 Y54.873 E100.7938 F2500
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""")
button = Button()
boolean_toggle = BooleanToggle(True)
