# Grasshopper definition mesh_component.gh (Grasshopper 1.0.8)
# plug-ins: CRFT Tools

brep = Brep(<brep referenced from the Rhino model>)
mesh = Mesh(brep)
mesh_editor = MeshEditor(Mesh=mesh, Enable=Toggle(True), Device=0)
