# Grasshopper definition plugin_tests.gh (Grasshopper 1.0.8)
# plug-ins: CRFT Tools

number_slider = Slider(0, range=0..1)
webcam = Webcam(Enable=Toggle(False), Device=Slider(0, range=0..1), Name="webcam")  # -> Image, RecordingPath
brep = Brep(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)
mesh = Mesh(brep)
panel = Panel("/private/tmp/frames_webcam_20250419_180845/webcam_20250419_181142.mp4")
mesh_hand_tracking = MeshHandTracking(
    Enable=Toggle(False),
    Mesh=mesh,
    Device=number_slider,
    Background=ColourSwatch(SwatchColor=RGB(204, 204, 204)),
    MeshFill=ColourSwatch(SwatchColor=RGB(20, 204, 186)),
    MeshEdge=ColourSwatch(SwatchColor=RGB(25, 255, 87)))
panel_2 = Panel(webcam.RecordingPath)
boolean_toggle = BooleanToggle(True)
file_path = FilePath("/Users/jorgemuyo/Desktop/crft/mediapipe/handtrack.py")
webcam_hand_tracking = WebcamHandTracking(
    Enable=Toggle(False),
    Device=number_slider,
    Name="webcam",
    TrackHands=Toggle(True),
    TrackFrequency=5,
    PythonPath=file_path)  # -> Image, VideoPath, HandLandmarks, DebugImage
sam_ui = SAMUI(VideoPath=panel_2, FrameRate=Slider(1, range=0..1), Run=False, Preserve=Toggle(True))  # -> Status, OutputPath, Points
ply_importer = PLYImporter(Import=True)  # -> Mesh, Vertices, Colors
